# Grasshopper definition C# file test.gh (Grasshopper 1.0.7)

geo = Geometry(<curve referenced from the Rhino model>)
c_script = CSharpScript(objs=geo, fine_sample=Slider(10, range=0..10))  # -> out, A, B, C; inputs objs: list of GeometryBase, fine_sample: Int32
# ---------- c_script: C# ----------
    var myobbsystem = new OBBSystem();

    int prec = Rhino.RhinoDoc.ActiveDoc.DistanceDisplayPrecision;
    string us = Rhino.RhinoDoc.ActiveDoc.GetUnitSystemName(true, false, false, false);

    List<GeometryBase> inputs = objs;
    int count = fine_sample;
    int passes = 0;
    List<Brep> bb = new List<Brep>();
    foreach (GeometryBase obj in objs)
    {
      Print("Step 1:checking object planarity/coplanarity...");
      DateTime dt = System.DateTime.Now;
      DateTime st = TimeZone.CurrentTimeZone.ToLocalTime(new DateTime(1970, 1, 1));
      double stime = (dt - st).TotalMilliseconds;
      Plane plane = myobbsystem.CheckObjCoPlanarity(objs);

      B = plane;
      Print("返回平面了");

      if(plane != null)
      {
        if (objs.Count == 1)
        {
          string msg = "Selected object is planar - ";
          Print("Selected object is planar - ");
        }
        else
        {
          string msg = "All selected objects are coplanar - ";
        
          msg += "launching 2D planar bounding rectangle calculation.";
          Console.WriteLine(msg);
        }
          //launch planar bounding box routine
          Box f_bb = Box.Empty;
          Point3d[] f_bbpt = Box.Empty.GetCorners();
          double curr_area = 1.0;
          int i = 0;

         

          
          myobbsystem.MinBoundingRectanglePlane(objs, plane, out f_bb, out curr_area, out i, false);


          passes = i;

        Brep newbb = Rhino.Geometry.Brep.CreateFromCornerPoints(f_bbpt[0], f_bbpt[1], f_bbpt[2], f_bbpt[3], 0.1);
          bb.Add(newbb);
          Console.WriteLine("k{}", f_bbpt);

          double fa = Math.Round(curr_area, prec);
          //msg = "{} refinement stages. ".format(passes)
          //msg += "Minimum bounding box area = {} sq. {}".format(fa, us)
          //msg += " Elapsed time: {:.2f} sec.".format(time.time() - st)

        
      }

      else
      {
        // standard sample count=10 --> 1000 boxes per pass
        // fine sample count=18 --> 5832 boxes per pass

        string cp_msg = "";


        if(objs.Count == 1)
        {
          cp_msg = "Selected object is not planar -";
        }

        else
        {
          cp_msg = "Selected object are not planar -";
        }
        cp_msg += "launching 3D bounding box calculation.";
        Console.WriteLine(cp_msg);
      }


      double curr_vol = 0.0;
      Plane wxy_plane = Rhino.Geometry.Plane.WorldXY;
      Box curr_bb = Box.Empty;

      myobbsystem.Min3DBoundingBox(objs, wxy_plane, count, false, false, out curr_bb, out curr_vol, out passes);

      bb.Add(curr_bb.ToBrep());
      double fv = Math.Round(curr_vol, prec);
      //    msg = "Final volume after {} passes is {} {}3".format(passes, fv, us)
      //msg += " | Elapsed time: {:.2f} sec.".format(time.time() - st)
      //Console.WriteLine(msg);
    }
    A = bb;
# ---------- c_script: C# additional code ----------
  public class OBBSystem

  {
    public Plane CheckObjCoPlanarity(List<GeometryBase> objs)
    {
      List<Point3d> ptlist = new List<Point3d>();
      Plane myplane = new Plane();
      bool myresult = new bool();

      RhinoDoc rd = RhinoDoc.ActiveDoc;
      double tol = rd.ModelAbsoluteTolerance;
      foreach (var obj in objs)
      {
        if (obj is Rhino.Geometry.Curve)
        {
          Curve objcurve = (Curve) obj;
          myresult = objcurve.TryGetPlane(out myplane, tol);

          //if (myresult == false)
          //{
          //Print("curve.TryGetPlane failed");
          //return myplane;
          //}
          NurbsCurve mynurbscurve = objcurve.ToNurbsCurve();


          for (int i = 0; i < mynurbscurve.Points.Count; i = i + 1)
          {

            ptlist.Add(mynurbscurve.Points[i].Location);

          }
          //Print("Here add a Curve");
        }

        else if (obj is Rhino.Geometry.Point)
        {
          Point objpoint = (Point) obj;
          ptlist.Add(objpoint.Location);
          //Print("Here add a Point");
        }

        else if (obj is Rhino.Geometry.PointCloud)
        {
          PointCloud objpointcloud = (PointCloud) obj;
          Point3d[] ptarray = objpointcloud.GetPoints();
          foreach (Point3d i in ptarray)
          {
            ptlist.Add(i);
          }
          //Print("Here add a PointCloud");
        }

        else if (obj is Rhino.Geometry.Brep)
        {
          Brep objbrep = (Brep) obj;
          foreach (BrepFace face in objbrep.Faces)
          {
            myresult = face.TryGetPlane(out myplane, tol);

            //if (myresult == false)
            //{
            ///Print("face.TryGetPlane failed");
            //    return myplane;
            //}
            NurbsSurface mysurfaceface = face.ToNurbsSurface();


            foreach (ControlPoint cp in mysurfaceface.Points)
            {
              ptlist.Add(cp.Location);
            }
            //Print("Here add a Brep");
          }
        }

        else if (obj is Rhino.Geometry.Surface)
        {
          Surface objsurface = (Surface) obj;
          myresult = objsurface.TryGetPlane(out myplane, tol);
          //if (myresult == false)
          //{
          //    Print("surface.TryGetPlane failed");
          //    return myplane;
          //}
          NurbsSurface mysurfaceface = objsurface.ToNurbsSurface();

          foreach (ControlPoint cp in mysurfaceface.Points)
          {
            ptlist.Add(cp.Location);
          }

          //Print("Here add a Surface");

        }

        else if (obj is Rhino.Geometry.Extrusion)
        {
          Extrusion objextrusion = (Extrusion) obj;
          myresult = objextrusion.TryGetPlane(out myplane, tol);
          //if (myresult == false)
          //{
          //    Print("surface.TryGetPlane failed");
          //    return myplane;
          //}

          NurbsSurface mysurfaceface = objextrusion.ToNurbsSurface();

          foreach (ControlPoint cp in mysurfaceface.Points)
          {
            ptlist.Add(cp.Location);
          }
          //Print("Here add a Extrusion");
        }

        else if (obj is Rhino.Geometry.Mesh)
        {
          Mesh objmesh = (Mesh) obj;
          foreach (Point3d vert in objmesh.Vertices)
          {
            ptlist.Add(vert);

          }
          //Print("Here add a mesh");
        }

        else
        {
          return myplane;
        }

      }
      Plane.FitPlaneToPoints(ptlist, out myplane);
      return myplane;
    }

    public Box BoundingBoxPlane(List<GeometryBase> objs, Plane plane, bool accurate)

    {
      Plane wxy_plane = Rhino.Geometry.Plane.WorldXY;
      Transform xform = Rhino.Geometry.Transform.ChangeBasis(wxy_plane, plane);
      BoundingBox bbox = Rhino.Geometry.BoundingBox.Empty;

      foreach (GeometryBase obj in objs)
      {
        BoundingBox objectbbox = Objectbbox(obj, xform, accurate);
        bbox = Rhino.Geometry.BoundingBox.Union(bbox, objectbbox);
      }

      if (bbox.IsValid != true)         //not sure its necessary
      {
        Box emptybox = Rhino.Geometry.Box.Empty;
        return emptybox;
      }

      Transform plane_to_world = Rhino.Geometry.Transform.ChangeBasis(plane, wxy_plane);


      Box box = new Rhino.Geometry.Box(bbox);
      box.Transform(plane_to_world);
      return box;
    }

    public Point3d[] BoundingBoxPlanept(List<GeometryBase> objs, Plane plane, bool accurate)
    {
      Plane wxy_plane = Rhino.Geometry.Plane.WorldXY;
      Transform xform = Rhino.Geometry.Transform.ChangeBasis(wxy_plane, plane);
      BoundingBox bbox = Rhino.Geometry.BoundingBox.Empty;

      foreach (GeometryBase obj in objs)
      {
        BoundingBox objectbbox = Objectbbox(obj, xform, accurate);
        bbox = Rhino.Geometry.BoundingBox.Union(bbox, objectbbox);
      }

      if (bbox.IsValid != true)         //not sure its necessary
      {
        Box emptybox = Rhino.Geometry.Box.Empty;
        return emptybox.GetCorners();
      }

      Transform plane_to_world = Rhino.Geometry.Transform.ChangeBasis(plane, wxy_plane);


      Point3d[] corners = bbox.GetCorners();
      foreach (Point3d corner in corners)
      {
        corner.Transform(plane_to_world);
      }
      return corners;



    }

    public BoundingBox Objectbbox(GeometryBase geom, Transform xform, bool accurate)
    {
      if (geom is Rhino.Geometry.Point)
      {
        Point geompt = (Point) geom;
        Point3d geompt3d = geompt.Location;
        if (xform != null)
        {
          geompt3d = xform * geompt3d;

          BoundingBox geompt3dbbox = new Rhino.Geometry.BoundingBox(geompt3d, geompt3d);
          return geompt3dbbox;
        }
      }
      return geom.GetBoundingBox(accurate);
    }

    public List<Plane> RotateCopyPlanes(double tot_ang, int count, List<Plane> init_planes, Vector3d dir_vec)
    {
      double inc = tot_ang / (count - 1);
      Point3d origin = new Rhino.Geometry.Point3d(0, 0, 0);
      List<Plane> planes = new List<Plane>();
      for (int i = 0; i < count; i++)
      {
        foreach (Plane init_plane in init_planes)
        {
          Plane new_plane = new Rhino.Geometry.Plane(init_plane);
          new_plane.Rotate(inc * i, dir_vec, origin);
          planes.Add(new_plane);
        }
      }
      return planes;
    }

    public List<Plane> GenerateOctantPlane(int count)
    {
      double tot_ang = Math.PI * 0.5;
      // generates an array of count^3 planes in 3 axes covering xyz positive octant
      Plane yz_plane = Rhino.Geometry.Plane.WorldYZ;
      List<Plane> yz_planelist = new List<Plane>();
      yz_planelist.Add(yz_plane);
      Vector3d Xdir_vec = new Rhino.Geometry.Vector3d(1, 0, 0); //X axis
      List<Plane> x_planes = RotateCopyPlanes(tot_ang, count, yz_planelist, Xdir_vec);


      Vector3d Ydir_vec = new Rhino.Geometry.Vector3d(0, -1, 0); //-Y axis
      List<Plane> xy_planes = RotateCopyPlanes(tot_ang, count, x_planes, Ydir_vec);

      Vector3d Zdir_vec = new Rhino.Geometry.Vector3d(0, 0, 1); //Z axis
      List<Plane> xyz_planes = RotateCopyPlanes(tot_ang, count, xy_planes, Zdir_vec);

      return xyz_planes;

    }

    public List<Plane> RotatedPlaneArray(Plane plane, double tot_ang, int divs, Vector3d axis)
    {
      List<Plane> out_plane = new List<Plane>();
      plane.Rotate(-tot_ang * 0.5, axis);
      out_plane.Add(new Rhino.Geometry.Plane(plane));
      double inc = tot_ang / (divs - 1);
      for(int i = 0; i < divs - 1; i++)
      {
        plane.Rotate(inc, axis);
        out_plane.Add(new Rhino.Geometry.Plane(plane));
      }
      return out_plane;
    }

    public List<Plane> RotatePlaneArray3D(Plane view_plane, double tot_ang, int divs)
    {
      //generate a 3D array of refinement planes (works with narrow angles)
      List<Plane> out_planes = new List<Plane>();
      //use RotatedPlaneArray to generate 'horizontal' left-right array (yaw)
      List<Plane> yaw_planes = RotatedPlaneArray(view_plane, tot_ang, divs, view_plane.ZAxis);
      foreach (Plane y_plane in yaw_planes)
      {
        //use RotatedPlaneArray to generate up-down 'tilt' array(roll)
        List<Plane> roll_planes = RotatedPlaneArray(y_plane, tot_ang, divs, y_plane.ZAxis);

        foreach (Plane r_plane in roll_planes)
        {
          //use RotatedPlaneArray to generate up-down 'tilt' array(pitch)
          List<Plane> pitch_planes = RotatedPlaneArray(r_plane, tot_ang, divs, r_plane.ZAxis);

          foreach (Plane p_plane in pitch_planes)
          {
            out_planes.Add(p_plane);
          }

        }
      }
      return out_planes;
    }

    public void MinBBPlane(List<GeometryBase> objs, out Plane best_plane, Plane init_plane, List<Plane> planes, ref Box curr_box, ref double curr_vol)
    {

      best_plane = init_plane;

      foreach (Plane plane in planes)
      {
        Box bb = BoundingBoxPlane(objs, plane, true);

        if (bb.Volume < curr_vol)
        {
          curr_vol = bb.Volume;
          best_plane = plane;
          curr_box = bb;
        }

      }

    }

    public void Min3DBoundingBox(List<GeometryBase> objs, Plane init_plane, int count, bool rel_stop, bool im_rep, out Box curr_bb, out double curr_vol, out int passes)
    {
      // for non-planar or non-coplanar object(s)
      // get initial fast bb in init plane (World XY), plus volume to compare
      //this is the main 2D bb calculation search function

      curr_bb = BoundingBoxPlane(objs, init_plane, false);

      curr_vol = curr_bb.Volume;



      double tot_ang = Math.PI * 0.5;  //90 degrees for intial octant
      double factor = 0.1; //angle reduction factor for each successive refinement pass
      int max_passes = 20; //safety factor
      int prec = Rhino.RhinoDoc.ActiveDoc.DistanceDisplayPrecision;
      string us = Rhino.RhinoDoc.ActiveDoc.GetUnitSystemName(true, false, false, false);

      //run intitial bb calculation
      List<Plane> xyz_planes = GenerateOctantPlane(count);
      Plane best_plane = new Plane();
      MinBBPlane(objs, out best_plane, init_plane, xyz_planes, ref curr_bb, ref curr_vol);
      //report the results of intial rough calculation
      if (im_rep == true)
      {
        Console.WriteLine("Initial pass 0, volume:{0} {1}3", Math.Round(curr_vol, prec), us);
      }
      //refine with smaller angles arround best fit plane, loop until...
      int i = 0;
      for(i = 0; i < max_passes; i++)
      {
        double prev_vol = curr_vol;

        //reduce angle by factor, use refinement planes to generate array

        tot_ang *= factor;
        List <Plane> ref_planes = RotatePlaneArray3D(best_plane, tot_ang, count);
        MinBBPlane(objs, out best_plane, best_plane, ref_planes, ref curr_bb, ref curr_vol);
        double vol_diff = prev_vol - curr_vol;//vol. diff. over last pass, should be positive or 0
        // print "Volume difference from last pass: {}".format(vol_diff) #debug(python language)
        // check if difference is less than minimum "significant"
        // rel_stop==True: relative stop value <.01% difference from previous

        if (rel_stop == true)
        {
          if (vol_diff < 0.0001 * prev_vol)
          {
            break;
          }
        }
        else
        {
          RhinoDoc rd = RhinoDoc.ActiveDoc;
          if (vol_diff < rd.ModelAbsoluteTolerance)
          {
            break;
          }
        }
        Rhino.RhinoApp.Wait();

        if (im_rep == true)
        {
          Console.WriteLine("Refine pass {0}, volume:{1} {2}3", i + 1, Math.Round(curr_vol, prec), us);
        }

        //get out of loop if escape is pressed

        if (Console.ReadKey().Key != ConsoleKey.Escape)
        {
          Console.WriteLine("Refinement aborted after {0} passes", i + 1);
          break;
        }
      }
      passes = i + 1;


    }

    public void PlanarMinBB(List<GeometryBase> objs, Plane plane, double tot_ang, int divs, out Plane curr_plane, out double curr_area)
    {
      double inc = tot_ang / divs;
      //rotate plane half total angle minus direction
      plane.Rotate(-tot_ang * 0.5, plane.ZAxis, plane.Origin);
      Box bb = BoundingBoxPlane(objs, plane, true);
      curr_plane = new Plane(plane);
      curr_area = BoxArea(bb);
      //loop through angle increments
      for(int i = 0; i < divs; i++)
      {
        plane.Rotate(inc, plane.ZAxis, plane.Origin);
        bb = BoundingBoxPlane(objs, plane, true);
        double new_area = BoxArea(bb);
        if (new_area < curr_area)
        {
          curr_area = new_area;
          curr_plane = plane;
        }
      }


    }

    public void MinBoundingRectanglePlane(List<GeometryBase> objs, Plane curr_plane, out Box f_bb, out Double curr_area, out int i, bool im_rep)
    {
      //pass True argument above if you want to print intermediate results
      //initialize
      double factor = 0.01;
      double angle = Math.PI * 0.5;
      int divs = 90;
      RhinoDoc rd = RhinoDoc.ActiveDoc;
      double tol = rd.ModelAbsoluteTolerance;
      string err_msg = "Unable to calculate bouding box area";
      f_bb = new Box();
      i = 0;
      DateTime dt = System.DateTime.Now;
      DateTime st = TimeZone.CurrentTimeZone.ToLocalTime(new DateTime(1970, 1, 1));
      double stime = (dt - st).TotalMilliseconds;

      ///get initial rough bounding box

      Box init_bb = BoundingBoxPlane(objs, curr_plane, false);
      curr_area = BoxArea(init_bb);
      if (im_rep == true)
      {
        Console.WriteLine("Initial area: {}", curr_area);
      }

      //main calculation loop
      int safe = 10;
      for (i = 0; i < safe; i++)
      {

        PlanarMinBB(objs, curr_plane, angle, divs, out curr_plane, out curr_area);
        double new_area = curr_area;
        //abort if area is 0 or extremly small
        if (new_area < tol * 0.1)
        {
          Console.WriteLine(err_msg);
          return;
        }
        //break out of loop if new area is the smae as prev. area within limit
        if (Math.Abs(curr_area - new_area) < factor * tol)
        {
          break;
        }
        //otherwise,decrease increments and loop
        curr_area = new_area;
        angle *= (1 / divs);
        if(im_rep == true)
        {
          Console.WriteLine("Refine stage {0} Area: {1}", i + 1, curr_area);
          Rhino.RhinoApp.Wait();//wait for command line to print...
        }
        if (i == 10)
        {
          Console.WriteLine("Max loop limit reached");//debug
        }
      }

      f_bb = BoundingBoxPlane(objs, curr_plane, true);


    }

    public double BoxArea(Box box)
    {
      return (box.X[1] - box.X[0]) * (box.Y[1] - box.Y[0]);
    }

  }
# ---------- end c_script ----------
number_slider = Slider(10, range=0..10)
# BoundingBoxPlane  错误
geo_2 = Geometry(<curve referenced from the Rhino model>)
geo_3 = Geometry([<curve referenced from the Rhino model> x2])
c_script_2 = CSharpScript(objs=geo_2)  # -> out, A, B, C; inputs objs: list of GeometryBase
# ---------- c_script_2: C# ----------
    Plane plane = Rhino.Geometry.Plane.WorldXY;
    Plane wxy_plane = Rhino.Geometry.Plane.WorldXY;
    Transform xform = Rhino.Geometry.Transform.ChangeBasis(wxy_plane, plane);
    BoundingBox bbox = Rhino.Geometry.BoundingBox.Empty;
    OBBSystem my = new OBBSystem();
    bool accurate = true;
    foreach (GeometryBase obj in objs)
    {
      BoundingBox objectbbox = my.Objectbbox(obj, xform, accurate);
      bbox = Rhino.Geometry.BoundingBox.Union(bbox, objectbbox);
    }

    if (bbox.IsValid != true)         //not sure its necessary
    {
      Box emptybox = Rhino.Geometry.Box.Empty;
      A= emptybox;
    }

    Transform plane_to_world = Rhino.Geometry.Transform.ChangeBasis(plane, wxy_plane);


    Box box = new Rhino.Geometry.Box(bbox);
    box.Transform(plane_to_world);
    A = box;
# ---------- c_script_2: C# additional code ----------
  public class OBBSystem

  {
    public BoundingBox Objectbbox(GeometryBase geom, Transform xform, bool accurate)
    {
      if (geom is Rhino.Geometry.Point)
      {
        Point geompt = (Point) geom;
        Point3d geompt3d = geompt.Location;
        if (xform != null)
        {
          geompt3d = xform * geompt3d;

          BoundingBox geompt3dbbox = new Rhino.Geometry.BoundingBox(geompt3d, geompt3d);
          return geompt3dbbox;
        }
      }
      return geom.GetBoundingBox(accurate);
    }
  }
# ---------- end c_script_2 ----------
panel = Panel(c_script.out)
c_script_3 = CSharpScript(objs=geo_3, fine_sample=Slider(10, range=0..10))  # -> out, A; inputs objs: list of GeometryBase, fine_sample: Int32
# ---------- c_script_3: C# ----------
    OBBSystem my = new OBBSystem();
    A = my.CombinedMinBBMulti(objs, fine_sample);
# ---------- c_script_3: C# additional code ----------
  public class OBBSystem

  {
    public Plane CheckObjCoPlanarity(List<GeometryBase> objs)
    {
      List<Point3d> ptlist = new List<Point3d>();
      Plane myplane = new Plane();
      bool myresult = new bool();
      string msg = "";
      RhinoDoc rd = RhinoDoc.ActiveDoc;
      double tol = rd.ModelAbsoluteTolerance;
      foreach (var obj in objs)
      {
        if (obj is Rhino.Geometry.Curve)
        {
          Curve objcurve = (Curve) obj;
          myresult = objcurve.TryGetPlane(out myplane, tol);

          if (myresult == false)
          {
            myplane = default(Plane);
            return myplane;
          }

          NurbsCurve mynurbscurve = objcurve.ToNurbsCurve();

          if(mynurbscurve == default(NurbsCurve))
          {
            myplane = default(Plane);
            return myplane;
          }

          for (int i = 0; i < mynurbscurve.Points.Count; i = i + 1)
          {

            ptlist.Add(mynurbscurve.Points[i].Location);

          }

        }

        else if (obj is Rhino.Geometry.Point)
        {
          Point objpoint = (Point) obj;
          ptlist.Add(objpoint.Location);

        }

        else if (obj is Rhino.Geometry.PointCloud)
        {
          PointCloud objpointcloud = (PointCloud) obj;
          Point3d[] ptarray = objpointcloud.GetPoints();
          foreach (Point3d i in ptarray)
          {
            ptlist.Add(i);
          }

        }

        else if (obj is Rhino.Geometry.Brep)
        {
          Brep objbrep = (Brep) obj;
          foreach (BrepFace face in objbrep.Faces)
          {
            myresult = face.TryGetPlane(out myplane, tol);

            if (myresult == false)
            {
              myplane = default(Plane);
              return myplane;
            }
            NurbsSurface mysurfaceface = face.ToNurbsSurface();

            if (mysurfaceface == default(NurbsSurface))
            {
              myplane = default(Plane);
              return myplane;
            }

            foreach (ControlPoint cp in mysurfaceface.Points)
            {
              ptlist.Add(cp.Location);
            }

          }
        }

        else if (obj is Rhino.Geometry.Surface)
        {
          Surface objsurface = (Surface) obj;
          myresult = objsurface.TryGetPlane(out myplane, tol);
          if (myresult == false)
          {
            myplane = default(Plane);
            return myplane;
          }

          NurbsSurface mysurfaceface = objsurface.ToNurbsSurface();

          if(mysurfaceface == default(NurbsSurface))
          {
            myplane = default(Plane);
            return myplane;
          }


          foreach (ControlPoint cp in mysurfaceface.Points)
          {
            ptlist.Add(cp.Location);
          }



        }

        else if (obj is Rhino.Geometry.Extrusion)
        {
          Extrusion objextrusion = (Extrusion) obj;
          myresult = objextrusion.TryGetPlane(out myplane, tol);
          if (myresult == false)
          {
            myplane = default(Plane);
            return myplane;
          }

          NurbsSurface mysurfaceface = objextrusion.ToNurbsSurface();
          if (mysurfaceface == default(NurbsSurface))
          {
            myplane = default(Plane);
            return myplane;
          }
          foreach (ControlPoint cp in mysurfaceface.Points)
          {
            ptlist.Add(cp.Location);
          }

        }

        else if (obj is Rhino.Geometry.Mesh)
        {
          Mesh objmesh = (Mesh) obj;
          foreach (Point3d vert in objmesh.Vertices)
          {
            ptlist.Add(vert);

          }

        }

        else
        {
          return myplane;
        }

      }
      Plane.FitPlaneToPoints(ptlist, out myplane);
      return myplane;
    }


    public Box BoundingBoxPlane(List<GeometryBase> objs, Plane plane, bool accurate)

    {
      Plane wxy_plane = Rhino.Geometry.Plane.WorldXY;
      Transform xform = Rhino.Geometry.Transform.ChangeBasis(wxy_plane, plane);
      BoundingBox bbox = Rhino.Geometry.BoundingBox.Empty;

      foreach (GeometryBase obj in objs)
      {
        BoundingBox objectbbox = Objectbbox(obj, xform, accurate);
        bbox = Rhino.Geometry.BoundingBox.Union(bbox, objectbbox);
      }

      if (bbox.IsValid != true)         //not sure its necessary
      {
        Box emptybox = Rhino.Geometry.Box.Empty;
        return emptybox;
      }

      Transform plane_to_world = Rhino.Geometry.Transform.ChangeBasis(plane, wxy_plane);


      Box box = new Rhino.Geometry.Box(bbox);
      box.Transform(plane_to_world);
      return box;
    }

    public Point3d[] BoundingBoxPlanept(List<GeometryBase> objs, Plane plane, bool accurate)
    {
      Plane wxy_plane = Rhino.Geometry.Plane.WorldXY;
      Transform xform = Rhino.Geometry.Transform.ChangeBasis(wxy_plane, plane);
      BoundingBox bbox = Rhino.Geometry.BoundingBox.Empty;

      foreach (GeometryBase obj in objs)
      {
        BoundingBox objectbbox = Objectbbox(obj, xform, accurate);
        bbox = Rhino.Geometry.BoundingBox.Union(bbox, objectbbox);
      }

      if (bbox.IsValid != true)         //not sure its necessary
      {
        Box emptybox = Rhino.Geometry.Box.Empty;
        return emptybox.GetCorners();
      }

      Transform plane_to_world = Rhino.Geometry.Transform.ChangeBasis(plane, wxy_plane);


      Point3d[] corners = bbox.GetCorners();
      foreach (Point3d corner in corners)
      {
        corner.Transform(plane_to_world);
      }
      return corners;



    }

    public BoundingBox Objectbbox(GeometryBase geom, Transform xform, bool accurate)
    {
      if (geom is Rhino.Geometry.Point)
      {
        Point geompt = (Point) geom;
        Point3d geompt3d = geompt.Location;
        if (xform != null)
        {
          geompt3d = xform * geompt3d;

          BoundingBox geompt3dbbox = new Rhino.Geometry.BoundingBox(geompt3d, geompt3d);
          return geompt3dbbox;
        }
      }

      if(xform != null)
      {
        return geom.GetBoundingBox(xform);
      }
      return geom.GetBoundingBox(accurate);
    }

    public List<Plane> RotateCopyPlanes(double tot_ang, int count, List<Plane> init_planes, Vector3d dir_vec)
    {
      double inc = tot_ang / (count - 1);
      Point3d origin = new Rhino.Geometry.Point3d(0, 0, 0);
      List<Plane> planes = new List<Plane>();
      for (int i = 0; i < count; i++)
      {
        foreach (Plane init_plane in init_planes)
        {
          Plane new_plane = new Rhino.Geometry.Plane(init_plane);
          new_plane.Rotate(inc * i, dir_vec, origin);
          planes.Add(new_plane);
        }
      }
      return planes;
    }

    public List<Plane> GenerateOctantPlane(int count)
    {
      double tot_ang = Math.PI * 0.5;
      // generates an array of count^3 planes in 3 axes covering xyz positive octant
      Plane yz_plane = Rhino.Geometry.Plane.WorldYZ;
      List<Plane> yz_planelist = new List<Plane>();
      yz_planelist.Add(yz_plane);
      Vector3d Xdir_vec = new Rhino.Geometry.Vector3d(1, 0, 0); //X axis
      List<Plane> x_planes = RotateCopyPlanes(tot_ang, count, yz_planelist, Xdir_vec);


      Vector3d Ydir_vec = new Rhino.Geometry.Vector3d(0, -1, 0); //-Y axis
      List<Plane> xy_planes = RotateCopyPlanes(tot_ang, count, x_planes, Ydir_vec);

      Vector3d Zdir_vec = new Rhino.Geometry.Vector3d(0, 0, 1); //Z axis
      List<Plane> xyz_planes = RotateCopyPlanes(tot_ang, count, xy_planes, Zdir_vec);

      return xyz_planes;

    }

    public List<Plane> RotatedPlaneArray(Plane plane, double tot_ang, int divs, Vector3d axis)
    {
      List<Plane> out_plane = new List<Plane>();
      plane.Rotate(-tot_ang * 0.5, axis);
      out_plane.Add(new Rhino.Geometry.Plane(plane));
      double inc = tot_ang / (divs - 1);
      for(int i = 0; i < divs - 1; i++)
      {
        plane.Rotate(inc, axis);
        out_plane.Add(new Rhino.Geometry.Plane(plane));
      }
      return out_plane;
    }

    public List<Plane> RotatePlaneArray3D(Plane view_plane, double tot_ang, int divs)
    {
      //generate a 3D array of refinement planes (works with narrow angles)
      List<Plane> out_planes = new List<Plane>();
      //use RotatedPlaneArray to generate 'horizontal' left-right array (yaw)
      List<Plane> yaw_planes = RotatedPlaneArray(view_plane, tot_ang, divs, view_plane.ZAxis);
      foreach (Plane y_plane in yaw_planes)
      {
        //use RotatedPlaneArray to generate up-down 'tilt' array(roll)
        List<Plane> roll_planes = RotatedPlaneArray(y_plane, tot_ang, divs, y_plane.ZAxis);

        foreach (Plane r_plane in roll_planes)
        {
          //use RotatedPlaneArray to generate up-down 'tilt' array(pitch)
          List<Plane> pitch_planes = RotatedPlaneArray(r_plane, tot_ang, divs, r_plane.ZAxis);

          foreach (Plane p_plane in pitch_planes)
          {
            out_planes.Add(p_plane);
          }

        }
      }
      return out_planes;
    }

    public void MinBBPlane(List<GeometryBase> objs, out Plane best_plane, Plane init_plane, List<Plane> planes, ref Box curr_box, ref double curr_vol)
    {

      best_plane = init_plane;

      foreach (Plane plane in planes)
      {
        Box bb = BoundingBoxPlane(objs, plane, true);

        if (bb.Volume < curr_vol)
        {
          curr_vol = bb.Volume;
          best_plane = plane;
          curr_box = bb;
        }

      }

    }

    public void Min3DBoundingBox(List<GeometryBase> objs, Plane init_plane, int count, bool rel_stop, bool im_rep, out Box curr_bb, out double curr_vol, out int passes)
    {
      // for non-planar or non-coplanar object(s)
      // get initial fast bb in init plane (World XY), plus volume to compare
      //this is the main 2D bb calculation search function

      curr_bb = BoundingBoxPlane(objs, init_plane, false);

      curr_vol = curr_bb.Volume;



      double tot_ang = Math.PI * 0.5;  //90 degrees for intial octant
      double factor = 0.1; //angle reduction factor for each successive refinement pass
      int max_passes = 20; //safety factor
      int prec = Rhino.RhinoDoc.ActiveDoc.DistanceDisplayPrecision;
      string us = Rhino.RhinoDoc.ActiveDoc.GetUnitSystemName(true, false, false, false);

      //run intitial bb calculation
      List<Plane> xyz_planes = GenerateOctantPlane(count);
      Plane best_plane = new Plane();
      MinBBPlane(objs, out best_plane, init_plane, xyz_planes, ref curr_bb, ref curr_vol);
      //report the results of intial rough calculation
      if (im_rep == true)
      {
        Console.WriteLine("Initial pass 0, volume:{0} {1}3", Math.Round(curr_vol, prec), us);
      }
      //refine with smaller angles arround best fit plane, loop until...
      int i = 0;
      for(i = 0; i < max_passes; i++)
      {
        double prev_vol = curr_vol;

        //reduce angle by factor, use refinement planes to generate array

        tot_ang *= factor;
        List <Plane> ref_planes = RotatePlaneArray3D(best_plane, tot_ang, count);
        MinBBPlane(objs, out best_plane, best_plane, ref_planes, ref curr_bb, ref curr_vol);
        double vol_diff = prev_vol - curr_vol;//vol. diff. over last pass, should be positive or 0
        // print "Volume difference from last pass: {}".format(vol_diff) #debug(python language)
        // check if difference is less than minimum "significant"
        // rel_stop==True: relative stop value <.01% difference from previous

        if (rel_stop == true)
        {
          if (vol_diff < 0.0001 * prev_vol)
          {
            break;
          }
        }
        else
        {
          RhinoDoc rd = RhinoDoc.ActiveDoc;
          if (vol_diff < rd.ModelAbsoluteTolerance)
          {
            break;
          }
        }
        Rhino.RhinoApp.Wait();

        if (im_rep == true)
        {
          Console.WriteLine("Refine pass {0}, volume:{1} {2}3", i + 1, Math.Round(curr_vol, prec), us);
        }

        //get out of loop if escape is pressed

        if (Console.ReadKey().Key != ConsoleKey.Escape)
        {
          Console.WriteLine("Refinement aborted after {0} passes", i + 1);
          break;
        }
      }
      passes = i + 1;


    }

    public void PlanarMinBB(List<GeometryBase> objs, Plane plane, double tot_ang, int divs, out Plane curr_plane, out double curr_area)
    {
      double inc = tot_ang / divs;
      //rotate plane half total angle minus direction
      plane.Rotate(-tot_ang * 0.5, plane.ZAxis, plane.Origin);
      Box bb = BoundingBoxPlane(objs, plane, true);
      curr_plane = new Plane(plane);
      curr_area = BoxArea(bb);
      //loop through angle increments
      for(int i = 0; i < divs; i++)
      {
        plane.Rotate(inc, plane.ZAxis, plane.Origin);
        bb = BoundingBoxPlane(objs, plane, true);
        double new_area = BoxArea(bb);
        if (new_area < curr_area)
        {
          curr_area = new_area;
          curr_plane = plane;
        }
      }


    }

    public void MinBoundingRectanglePlane(List<GeometryBase> objs, Plane curr_plane, out Box f_bb, out Double curr_area, out int i, bool im_rep)
    {
      //pass True argument above if you want to print intermediate results
      //initialize
      double factor = 0.01;
      double angle = Math.PI * 0.5;
      int divs = 90;
      RhinoDoc rd = RhinoDoc.ActiveDoc;
      double tol = rd.ModelAbsoluteTolerance;
      string err_msg = "Unable to calculate bouding box area";
      f_bb = new Box();
      i = 0;
      DateTime dt = System.DateTime.Now;
      DateTime st = TimeZone.CurrentTimeZone.ToLocalTime(new DateTime(1970, 1, 1));
      double stime = (dt - st).TotalMilliseconds;

      ///get initial rough bounding box

      Box init_bb = BoundingBoxPlane(objs, curr_plane, false);
      curr_area = BoxArea(init_bb);
      if (im_rep == true)
      {
        Console.WriteLine("Initial area: {}", curr_area);
      }

      //main calculation loop
      int safe = 10;
      for (i = 0; i < safe; i++)
      {

        PlanarMinBB(objs, curr_plane, angle, divs, out curr_plane, out curr_area);
        double new_area = curr_area;
        //abort if area is 0 or extremly small
        if (new_area < tol * 0.1)
        {
          Console.WriteLine(err_msg);
          return;
        }
        //break out of loop if new area is the smae as prev. area within limit
        if (Math.Abs(curr_area - new_area) < factor * tol)
        {
          break;
        }
        //otherwise,decrease increments and loop
        curr_area = new_area;
        angle *= (1 / divs);
        if(im_rep == true)
        {
          Console.WriteLine("Refine stage {0} Area: {1}", i + 1, curr_area);
          Rhino.RhinoApp.Wait();//wait for command line to print...
        }
        if (i == 10)
        {
          Console.WriteLine("Max loop limit reached");//debug
        }
      }

      f_bb = BoundingBoxPlane(objs, curr_plane, true);


    }

    public double BoxArea(Box box)
    {
      return (box.X[1] - box.X[0]) * (box.Y[1] - box.Y[0]);
    }
    public List<Brep> CombinedMinBBMulti(List<GeometryBase> objs, int fine_sample)
    {
      int prec = Rhino.RhinoDoc.ActiveDoc.DistanceDisplayPrecision;
      string us = Rhino.RhinoDoc.ActiveDoc.GetUnitSystemName(true, false, false, false);
      string OUT = "";
      List<GeometryBase> inputs = objs;
      int count = fine_sample;
      int passes = 0;
      List<Brep> bb = new List<Brep>();
      foreach (GeometryBase obj in objs)
      {
        Console.WriteLine("checking object planarity/coplanarity...");
        DateTime dt = System.DateTime.Now;
        DateTime st = TimeZone.CurrentTimeZone.ToLocalTime(new DateTime(1970, 1, 1));
        double stime = (dt - st).TotalMilliseconds;
        Plane plane = CheckObjCoPlanarity(objs);

        if(plane != null)
        {
          if (objs.Count == 1)
          {
            string msg = "Selected object is planar - ";
          }
          else
          {
            string msg = "All selected objects are coplanar - ";
            msg += "launching 2D planar bounding rectangle calculation.";
            Console.WriteLine(msg);


            //launch planar bounding box routine
            Box f_bb = Box.Empty;
            Point3d[] f_bbpt = Box.Empty.GetCorners();
            double curr_area = 1.0;
            int i = 0;

            MinBoundingRectanglePlane(objs, plane, out f_bb, out curr_area, out i, true);
            passes = i;

            bb.Add(Rhino.Geometry.Brep.CreateFromCornerPoints(f_bbpt[0], f_bbpt[1], f_bbpt[2], f_bbpt[3], 0.1));
            Console.WriteLine("k{}", f_bbpt);

            double fa = Math.Round(curr_area, prec);
            //msg = "{} refinement stages. ".format(passes)
            //msg += "Minimum bounding box area = {} sq. {}".format(fa, us)
            //msg += " Elapsed time: {:.2f} sec.".format(time.time() - st)

          }
        }

        else
        {
          // standard sample count=10 --> 1000 boxes per pass
          // fine sample count=18 --> 5832 boxes per pass

          string cp_msg = "";


          if(objs.Count == 1)
          {
            cp_msg = "Selected object is not planar -";
          }

          else
          {
            cp_msg = "Selected object are not planar -";
          }
          cp_msg += "launching 3D bounding box calculation.";
          Console.WriteLine(cp_msg);
        }


        double curr_vol = 0.0;
        Plane wxy_plane = Rhino.Geometry.Plane.WorldXY;
        Box curr_bb = Box.Empty;

        Min3DBoundingBox(objs, wxy_plane, count, false, false, out curr_bb, out curr_vol, out passes);

        bb.Add(curr_bb.ToBrep());
        double fv = Math.Round(curr_vol, prec);
        //    msg = "Final volume after {} passes is {} {}3".format(passes, fv, us)
        //msg += " | Elapsed time: {:.2f} sec.".format(time.time() - st)
        //Console.WriteLine(msg);
      }
      return bb;
    }

  }
# ---------- end c_script_3 ----------
panel_2 = Panel(c_script_2.out)
panel_3 = Panel(c_script_3.out)
