# Grasshopper definition 20220103 VSCode_GH_test.gh (Grasshopper 1.0.7)

geo = Geometry([<curve referenced from the Rhino model> x2])  # disabled
geo_2 = Geometry(<curve referenced from the Rhino model>)
# 平面情况成功
# MinBoundingRectanglePlane
geo_3 = Geometry(<curve referenced from the Rhino model>)
series = Series(Start=0, Step=1, Count=10)
# RotatePlane Array3D
python = GhPythonScript()  # -> out, A
# ---------- python: Python ----------
__author__ = "User"
__version__ = "2022.01.01"

import rhinoscriptsyntax as rs
import Rhino
def RotatedPlaneArray(plane,tot_ang,divs,axis):
    """creates an array of planes rotated in increments around an axis
    tot_ang=total array inc. angle (rads); divided into divs number of divisions
    included angle is interval from -tot_ang/2 to +tot_ang/2
    number of output planes is divs; number of angle divisions is divs-1 """
    out_planes=[]
    plane.Rotate(-tot_ang*0.5,axis)
    out_planes.append(Rhino.Geometry.Plane(plane))
    inc=tot_ang/(divs-1)
    for i in range(divs-1):
        plane.Rotate(inc,axis)
        out_planes.append(Rhino.Geometry.Plane(plane))
    return out_planes

#used in 3D refinement calculation 
def RotatePlaneArray3D(view_plane,tot_ang,divs):
    #generate a 3D array of refinement planes (works with narrow angles)
    out_planes=[]
    #use RotatedPlaneArray to generate 'horizontal' left-right array (yaw)
    yaw_planes=RotatedPlaneArray(view_plane,tot_ang,divs,view_plane.ZAxis)
    for y_plane in yaw_planes:
        #use RotatedPlaneArray to generate side-to-side 'tilt' array (roll)
        roll_planes=RotatedPlaneArray(y_plane,tot_ang,divs,y_plane.YAxis)
        for r_plane in roll_planes:
            #use RotatedPlaneArray to generate up-down 'tilt' array (pitch)
            pitch_planes=RotatedPlaneArray(r_plane,tot_ang,divs,r_plane.XAxis)
            for p_plane in pitch_planes:
                out_planes.append(p_plane)
    return out_planes
    
    
tot_ang = 90;
divs = 3;
myplane = Rhino.Geometry.Plane.WorldXY;
A = RotatePlaneArray3D(myplane, tot_ang, divs);
# ---------- end python ----------
series_2 = Series(Start=0, Step=1, Count=10)
# generateoctant plane
python_2 = GhPythonScript()  # -> out, A
# ---------- python_2: Python ----------
__author__ = "User"
__version__ = "2022.01.01"

import rhinoscriptsyntax as rs
import Rhino
import math

def GenerateOctantPlanes(count):
    tot_ang=math.pi*0.5 #90 degrees
    #generates an array of count^3 planes in 3 axes covering xyz positive octant
    yz_plane=Rhino.Geometry.Plane.WorldYZ
    dir_vec=Rhino.Geometry.Vector3d(1,0,0) #X axis
    x_planes=RotateCopyPlanes(tot_ang,count,yz_plane,dir_vec)
    dir_vec=Rhino.Geometry.Vector3d(0,-1,0) #-Y axis
    xy_planes=RotateCopyPlanes(tot_ang,count,x_planes,dir_vec)
    dir_vec=Rhino.Geometry.Vector3d(0,0,1) #Z axis
    xyz_planes=RotateCopyPlanes(tot_ang,count,xy_planes,dir_vec)
    return xyz_planes
    
def RotateCopyPlanes(tot_ang,count,init_planes,dir_vec):
    """takes a single plane or list of planes as input
    rotates/copies planes through angle tot_ang
    number of planes=count, number of angle divisions=count-1"""
    if isinstance(init_planes,Rhino.Geometry.Plane): init_planes=[init_planes]
    inc=tot_ang/(count-1)
    origin=Rhino.Geometry.Point3d(0,0,0)
    planes=[]
    
    for i in range(count):
        for init_plane in init_planes:
            new_plane=Rhino.Geometry.Plane(init_plane)
            new_plane.Rotate(inc*i,dir_vec,origin)
            planes.append(new_plane)
    return planes
    
    
    
A=GenerateOctantPlanes(6)
# ---------- end python_2 ----------
xy = XYPlane(Origin=Point(0, 0, 0))
number_slider = Slider(3, range=0..10)
xy_2 = XYPlane(Origin=Point(0, 0, 0))
bbox = BoundingBox(Content=geo_2, Plane=PlaneXY(0, 0, 0))  # -> Box, Box_2
toggle = BooleanToggle(False)
toggle_2 = BooleanToggle(False)
rotate = Rotate(Geometry=xy, Angle=series, Plane=PlaneXY(0, 0, 0))  # -> Geometry, Transform
bbox_2 = BoundingBox(Content=geo, Plane=PlaneXY(0, 0, 0))  # -> Box, Box_2
c_script = CSharpScript(objs=geo_3)  # -> out, A, B, C; inputs objs: list of GeometryBase
# ---------- c_script: C# ----------
    //pass True argument above if you want to print intermediate results
    //initialize
    obbs my = new obbs();


    Plane curr_plane = Plane.WorldXY;

    RhinoDoc rd = RhinoDoc.ActiveDoc;
    double tol = rd.ModelAbsoluteTolerance;

    Box f_bb = new Box();

    double curr_area = 0;
    int i = 0;






    my.MinBoundingRectanglePlane(objs, curr_plane, out  f_bb, out  curr_area, out i);
    B = f_bb;
    A = curr_area;
# ---------- c_script: C# additional code ----------
  class obbs
  {
    public BoundingBox Objectbbox(GeometryBase geom, Transform xform, bool accurate)
    {
      if (geom is Rhino.Geometry.Point)
      {
        Point geompt = (Point) geom;
        Point3d geompt3d = geompt.Location;
        if (xform != null)
        {
          geompt3d = xform * geompt3d;

          BoundingBox geompt3dbbox = new Rhino.Geometry.BoundingBox(geompt3d, geompt3d);
          return geompt3dbbox;
        }
      }

      if (xform != null)
      {
        return geom.GetBoundingBox(xform);
      }
      return geom.GetBoundingBox(accurate);
    }

    public Box BoundingBoxPlane(List<GeometryBase> objs, Plane plane, bool accurate)
    {
      accurate = true;
      Plane wxy_plane = Rhino.Geometry.Plane.WorldXY;
      Transform xform = Rhino.Geometry.Transform.ChangeBasis(wxy_plane, plane);
      BoundingBox bbox = Rhino.Geometry.BoundingBox.Empty;

      foreach (GeometryBase obj in objs)
      {
        BoundingBox objectbbox = Objectbbox(obj, xform, accurate);
        bbox = Rhino.Geometry.BoundingBox.Union(bbox, objectbbox);
      }

      if (bbox.IsValid != true)         //not sure its necessary
      {
        Box emptybox = Rhino.Geometry.Box.Empty;
        return emptybox;
      }

      Transform plane_to_world = Rhino.Geometry.Transform.ChangeBasis(plane, wxy_plane);


      Box box = new Rhino.Geometry.Box(bbox);
      box.Transform(plane_to_world);
      return box;
    }

    public double BoxArea(Box box)
    {
      return (box.X[1] - box.X[0]) * (box.Y[1] - box.Y[0]);
    }


    public void PlanarMinBB(List<GeometryBase> objs, Plane plane, double tot_ang, int divs, out Plane curr_plane, out double curr_area)
    {
      double inc = tot_ang / divs;
      //rotate plane half total angle minus direction
      plane.Rotate(-tot_ang * 0.5, plane.ZAxis, plane.Origin);
      Box bb = BoundingBoxPlane(objs, plane, true);
      curr_plane = new Plane(plane);
      curr_area = BoxArea(bb);
      //loop through angle increments
      for(int i = 0; i < divs; i++)
      {
        plane.Rotate(inc, plane.ZAxis, plane.Origin);
        bb = BoundingBoxPlane(objs, plane, true);
        double new_area = BoxArea(bb);
        if (new_area < curr_area)
        {
          curr_area = new_area;
          curr_plane = plane;
        }
      }


    }

    public void MinBoundingRectanglePlane(List<GeometryBase> objs, Plane curr_plane, out Box f_bb, out Double curr_area, out int i)
    {
      //pass True argument above if you want to print intermediate results
      //initialize
      double factor = 0.01;
      double angle = Math.PI * 0.5;
      int divs = 90;
      RhinoDoc rd = RhinoDoc.ActiveDoc;
      double tol = rd.ModelAbsoluteTolerance;
      string err_msg = "Unable to calculate bouding box area";
      bool im_rep = false;
      f_bb = new Box();
      i = 0;
      DateTime dt = System.DateTime.Now;
      DateTime st = TimeZone.CurrentTimeZone.ToLocalTime(new DateTime(1970, 1, 1));
      double stime = (dt - st).TotalMilliseconds;

      ///get initial rough bounding box

      Box init_bb = BoundingBoxPlane(objs, curr_plane, false);
      curr_area = BoxArea(init_bb);
      if (im_rep == true)
      {
        Console.WriteLine("Initial area: {}", curr_area);
      }

      //main calculation loop
      int safe = 10;
      for (i = 0; i < safe; i++)
      {

        PlanarMinBB(objs, curr_plane, angle, divs, out curr_plane, out curr_area);
        double new_area = curr_area;
        //abort if area is 0 or extremly small
        if (new_area < tol * 0.1)
        {
          Console.WriteLine(err_msg);
          return;
        }
        //break out of loop if new area is the smae as prev. area within limit
        if (Math.Abs(curr_area - new_area) < factor * tol)
        {
          break;
        }
        //otherwise,decrease increments and loop
        curr_area = new_area;
        angle *= (1 / divs);
        if(im_rep == true)
        {
          Console.WriteLine("Refine stage {0} Area: {1}", i + 1, curr_area);
          Rhino.RhinoApp.Wait();//wait for command line to print...
        }
        if (i == 10)
        {
          Console.WriteLine("Max loop limit reached");//debug
        }
      }

      f_bb = BoundingBoxPlane(objs, curr_plane, true);


    }
  }
# ---------- end c_script ----------
rotate_2 = Rotate(Geometry=xy_2, Angle=series_2, Plane=PlaneXY(0, 0, 0))  # -> Geometry, Transform
panel = Panel(python.A)
# 非共面
# MinBoundingRectanglePlane
panel_2 = Panel(python_2.A)
# minBBPlane
python_3 = GhPythonScript(objs=geo_2, best_plane=xy, planes=rotate.Geometry, curr_box=bbox.Box)  # -> out, A, B, C; inputs objs: list of GeometryBase, planes: list of Plane
# ---------- python_3: Python ----------
__author__ = "User"
__version__ = "2022.01.01"

import rhinoscriptsyntax as rs
import Rhino
def MinBBPlane(objs,best_plane,planes,curr_box,curr_vol):
    """returns plane with smallest aligned bounding box volume
    from list of input objects, planes to test and initial compare volume
    best plane, volume, and bbox pass through if no better solution found"""
    for plane in planes:
        bb=BoundingBoxPlane(objs,plane,ret_pts=False)
        if bb.Volume<curr_vol:
            curr_vol=bb.Volume
            best_plane=plane
            curr_box=bb
    return best_plane,curr_box,curr_vol

def BoundingBoxPlane(objs,plane,ret_pts=False,accurate=True):
    """returns a plane-aligned bounding box in world coordinates
       - input geometry must be RhinoCommon geometry (not IDs)
       - adapted from python rhinoscriptsyntax rs.BoundingBox() code."""
    wxy_plane=Rhino.Geometry.Plane.WorldXY
    def __objectbbox(geom,xform):
        if isinstance(geom,Rhino.Geometry.Point):
            pt=geom.Location
            if xform: pt = xform * pt
            return Rhino.Geometry.BoundingBox(pt,pt)
        if xform: return geom.GetBoundingBox(xform)
        return geom.GetBoundingBox(accurate)
    
    xform = Rhino.Geometry.Transform.ChangeBasis(wxy_plane, plane)
    bbox = Rhino.Geometry.BoundingBox.Empty
    if type(objs) is list or type(objs) is tuple:
        for obj in objs:
            objectbbox = __objectbbox(obj, xform)
            bbox = Rhino.Geometry.BoundingBox.Union(bbox,objectbbox)
    else:
        objectbbox = __objectbbox(objs, xform)
        bbox = Rhino.Geometry.BoundingBox.Union(bbox,objectbbox)
    if not bbox.IsValid: return
    plane_to_world = Rhino.Geometry.Transform.ChangeBasis(plane,wxy_plane)
    if ret_pts:
        corners = list(bbox.GetCorners())
        for pt in corners: pt.Transform(plane_to_world)
        return corners
    else:
        box=Rhino.Geometry.Box(bbox)
        box.Transform(plane_to_world)
        return box
        

curr_vol=4000
A,B,C = MinBBPlane(objs,best_plane,planes,curr_box,curr_vol)
# ---------- end python_3 ----------
# Min3DBoundingBox
python_4 = GhPythonScript(
    objs=geo,
    init_plane=xy_2,
    best_plane=xy_2,
    planes=rotate_2.Geometry,
    count=number_slider,
    curr_box=bbox_2.Box,
    rel_stop=toggle,
    im_rep=toggle_2)  # -> out, A, B, C; inputs objs: list of GeometryBase, planes: list of Plane, count: Int32
# ---------- python_4: Python ----------
__author__ = "User"
__version__ = "2022.01.01"

import rhinoscriptsyntax as rs
import Rhino
import math
import rhinoscriptsyntax as sc

def RotatedPlaneArray(plane,tot_ang,divs,axis):
    """creates an array of planes rotated in increments around an axis
    tot_ang=total array inc. angle (rads); divided into divs number of divisions
    included angle is interval from -tot_ang/2 to +tot_ang/2
    number of output planes is divs; number of angle divisions is divs-1 """
    out_planes=[]
    plane.Rotate(-tot_ang*0.5,axis)
    out_planes.append(Rhino.Geometry.Plane(plane))
    inc=tot_ang/(divs-1)
    for i in range(divs-1):
        plane.Rotate(inc,axis)
        out_planes.append(Rhino.Geometry.Plane(plane))
    return out_planes

#used in 3D refinement calculation 
def RotatePlaneArray3D(view_plane,tot_ang,divs):
    #generate a 3D array of refinement planes (works with narrow angles)
    out_planes=[]
    #use RotatedPlaneArray to generate 'horizontal' left-right array (yaw)
    yaw_planes=RotatedPlaneArray(view_plane,tot_ang,divs,view_plane.ZAxis)
    for y_plane in yaw_planes:
        #use RotatedPlaneArray to generate side-to-side 'tilt' array (roll)
        roll_planes=RotatedPlaneArray(y_plane,tot_ang,divs,y_plane.YAxis)
        for r_plane in roll_planes:
            #use RotatedPlaneArray to generate up-down 'tilt' array (pitch)
            pitch_planes=RotatedPlaneArray(r_plane,tot_ang,divs,r_plane.XAxis)
            for p_plane in pitch_planes:
                out_planes.append(p_plane)
    return out_planes
    
    
def GenerateOctantPlanes(count):
    tot_ang=math.pi*0.5 #90 degrees
    #generates an array of count^3 planes in 3 axes covering xyz positive octant
    yz_plane=Rhino.Geometry.Plane.WorldYZ
    dir_vec=Rhino.Geometry.Vector3d(1,0,0) #X axis
    x_planes=RotateCopyPlanes(tot_ang,count,yz_plane,dir_vec)
    dir_vec=Rhino.Geometry.Vector3d(0,-1,0) #-Y axis
    xy_planes=RotateCopyPlanes(tot_ang,count,x_planes,dir_vec)
    dir_vec=Rhino.Geometry.Vector3d(0,0,1) #Z axis
    xyz_planes=RotateCopyPlanes(tot_ang,count,xy_planes,dir_vec)
    return xyz_planes
    
def RotateCopyPlanes(tot_ang,count,init_planes,dir_vec):
    """takes a single plane or list of planes as input
    rotates/copies planes through angle tot_ang
    number of planes=count, number of angle divisions=count-1"""
    if isinstance(init_planes,Rhino.Geometry.Plane): init_planes=[init_planes]
    inc=tot_ang/(count-1)
    origin=Rhino.Geometry.Point3d(0,0,0)
    planes=[]
    
    for i in range(count):
        for init_plane in init_planes:
            new_plane=Rhino.Geometry.Plane(init_plane)
            new_plane.Rotate(inc*i,dir_vec,origin)
            planes.append(new_plane)
    return planes
def Min3DBoundingBox(objs,init_plane,count,rel_stop,im_rep):
    #for non-planar or non-coplanar object(s)
    #get initial fast bb in init plane (World XY), plus volume to compare
    curr_bb=BoundingBoxPlane(objs,init_plane,False)
    curr_vol=curr_bb.Volume
    
    tot_ang=math.pi*0.5 #90 degrees for intial octant
    factor=0.1 #angle reduction factor for each successive refinement pass
    max_passes=20 #safety factor
    prec=Rhino.RhinoDoc.ActiveDoc.DistanceDisplayPrecision
    us=Rhino.RhinoDoc.ActiveDoc.GetUnitSystemName(True, False, False, False)
    
    #run intitial bb calculation
    xyz_planes=GenerateOctantPlanes(count)
    best_plane,curr_bb,curr_vol=MinBBPlane(objs,init_plane,xyz_planes,curr_bb,curr_vol)
    #report results of intial rough calculation
    if im_rep:
        print "Initial pass 0, volume: {} {}3".format(round(curr_vol,prec),us)
    #refine with smaller angles around best fit plane, loop until...
    for i in range(max_passes):
        prev_vol=curr_vol
        #reduce angle by factor, use refinement planes to generate array
        tot_ang*=factor
        ref_planes=RotatePlaneArray3D(best_plane,tot_ang,count)
        best_plane,curr_bb,curr_vol=MinBBPlane(objs,best_plane,ref_planes,curr_bb,curr_vol)
        vol_diff=prev_vol-curr_vol #vol. diff. over last pass, should be positive or 0
        #print "Volume difference from last pass: {}".format(vol_diff) #debug
        #check if difference is less than minimum "significant"
        #rel_stop==True: relative stop value <.01% difference from previous
        if rel_stop:
            if vol_diff<0.0001*prev_vol: break
        else:
            if vol_diff<Rhino.RhinoDoc.ModelAbsoluteTolerance: break
        Rhino.RhinoApp.Wait()
        if im_rep:
            print "Refine pass {}, volume: {} {}3".format(i+1,round(curr_vol,prec),us)
        #get out of loop if escape is pressed
        if sc.escape_test(False):
            print "Refinement aborted after {} passes.".format(i+1)
            break
            
    return curr_bb,curr_vol,i+1
    
def MinBBPlane(objs,best_plane,planes,curr_box,curr_vol):
    """returns plane with smallest aligned bounding box volume
    from list of input objects, planes to test and initial compare volume
    best plane, volume, and bbox pass through if no better solution found"""
    for plane in planes:
        bb=BoundingBoxPlane(objs,plane,ret_pts=False)
        if bb.Volume<curr_vol:
            curr_vol=bb.Volume
            best_plane=plane
            curr_box=bb
    return best_plane,curr_box,curr_vol

def BoundingBoxPlane(objs,plane,ret_pts=False,accurate=True):
    """returns a plane-aligned bounding box in world coordinates
       - input geometry must be RhinoCommon geometry (not IDs)
       - adapted from python rhinoscriptsyntax rs.BoundingBox() code."""
    wxy_plane=Rhino.Geometry.Plane.WorldXY
    def __objectbbox(geom,xform):
        if isinstance(geom,Rhino.Geometry.Point):
            pt=geom.Location
            if xform: pt = xform * pt
            return Rhino.Geometry.BoundingBox(pt,pt)
        if xform: return geom.GetBoundingBox(xform)
        return geom.GetBoundingBox(accurate)
    
    xform = Rhino.Geometry.Transform.ChangeBasis(wxy_plane, plane)
    bbox = Rhino.Geometry.BoundingBox.Empty
    if type(objs) is list or type(objs) is tuple:
        for obj in objs:
            objectbbox = __objectbbox(obj, xform)
            bbox = Rhino.Geometry.BoundingBox.Union(bbox,objectbbox)
    else:
        objectbbox = __objectbbox(objs, xform)
        bbox = Rhino.Geometry.BoundingBox.Union(bbox,objectbbox)
    if not bbox.IsValid: return
    plane_to_world = Rhino.Geometry.Transform.ChangeBasis(plane,wxy_plane)
    if ret_pts:
        corners = list(bbox.GetCorners())
        for pt in corners: pt.Transform(plane_to_world)
        return corners
    else:
        box=Rhino.Geometry.Box(bbox)
        box.Transform(plane_to_world)
        return box
        

curr_vol=4000


A,B,C = Min3DBoundingBox(objs,init_plane,count,rel_stop,im_rep)
# ---------- end python_4 ----------
geo_4 = Geometry(c_script.B)
panel_3 = Panel(python_4.out)
panel_4 = Panel(c_script.out)
# RotatePlane Array3D
c_script_2 = CSharpScript()  # -> out, A
# ---------- c_script_2: C# ----------
    obbs my = new obbs();

    double tot_ang = 90;
    int divs = 3;
    Plane myplane = Plane.WorldXY;
    A = my.RotatePlaneArray3D(myplane, tot_ang, divs);
# ---------- c_script_2: C# additional code ----------
  class obbs
  {
    public List<Plane> RotatedPlaneArray(Plane plane, double tot_ang, int divs, Vector3d axis)
    {
      List<Plane> out_plane = new List<Plane>();
      plane.Rotate(-tot_ang * 0.5, axis);
      out_plane.Add(new Rhino.Geometry.Plane(plane));
      double inc = tot_ang / (divs - 1);
      for(int i = 0; i < divs - 1; i++)
      {
        plane.Rotate(inc, axis);
        out_plane.Add(new Rhino.Geometry.Plane(plane));
      }
      return out_plane;
    }
    public List<Plane> RotatePlaneArray3D(Plane view_plane, double tot_ang, int divs)
    {
      //generate a 3D array of refinement planes (works with narrow angles)
      List<Plane> out_planes = new List<Plane>();
      //use RotatedPlaneArray to generate 'horizontal' left-right array (yaw)
      List<Plane> yaw_planes = RotatedPlaneArray(view_plane, tot_ang, divs, view_plane.ZAxis);
      foreach (Plane y_plane in yaw_planes)
      {
        //use RotatedPlaneArray to generate up-down 'tilt' array(roll)
        List<Plane> roll_planes = RotatedPlaneArray(y_plane, tot_ang, divs, y_plane.YAxis);

        foreach (Plane r_plane in roll_planes)
        {
          //use RotatedPlaneArray to generate up-down 'tilt' array(pitch)
          List<Plane> pitch_planes = RotatedPlaneArray(r_plane, tot_ang, divs, r_plane.XAxis);

          foreach (Plane p_plane in pitch_planes)
          {
            out_planes.Add(p_plane);
          }

        }
        
      }
      return out_planes;
    }

  }
# ---------- end c_script_2 ----------
# C#
# generateoctant plane
c_script_3 = CSharpScript()  # -> out, A
# ---------- c_script_3: C# ----------
    obbs my = new obbs();
    int count = 6;
    double tot_ang = Math.PI * 0.5;
    // generates an array of count^3 planes in 3 axes covering xyz positive octant
    Plane yz_plane = Rhino.Geometry.Plane.WorldYZ;
    List<Plane> yz_planelist = new List<Plane>();
    yz_planelist.Add(yz_plane);
    Vector3d Xdir_vec = new Rhino.Geometry.Vector3d(1, 0, 0); //X axis
    List<Plane> x_planes = my.RotateCopyPlanes(tot_ang, count, yz_planelist, Xdir_vec);


    Vector3d Ydir_vec = new Rhino.Geometry.Vector3d(0, -1, 0); //-Y axis
    List<Plane> xy_planes = my.RotateCopyPlanes(tot_ang, count, x_planes, Ydir_vec);

    Vector3d Zdir_vec = new Rhino.Geometry.Vector3d(0, 0, 1); //Z axis
    List<Plane> xyz_planes = my.RotateCopyPlanes(tot_ang, count, xy_planes, Zdir_vec);

    A = xyz_planes;
# ---------- c_script_3: C# additional code ----------
  class obbs
  {
    public List<Plane> RotateCopyPlanes(double tot_ang, int count, List<Plane> init_planes, Vector3d dir_vec)
    {
      double inc = tot_ang / (count - 1);
      Point3d origin = new Rhino.Geometry.Point3d(0, 0, 0);
      List<Plane> planes = new List<Plane>();
      for (int i = 0; i < count; i++)
      {
        foreach (Plane init_plane in init_planes)
        {
          Plane new_plane = new Rhino.Geometry.Plane(init_plane);
          new_plane.Rotate(inc * i, dir_vec, origin);
          planes.Add(new_plane);
        }
      }
      return planes;
    }
  }
# ---------- end c_script_3 ----------
panel_5 = Panel(c_script_2.A)
# minBBPlane
c_script_4 = CSharpScript(objs=geo_2, best_plane=xy, planes=rotate.Geometry, curr_box=bbox.Box)  # -> out, A, B, C; inputs objs: list of GeometryBase, best_plane: Plane, planes: list of Plane, curr_box: Box
# ---------- c_script_4: C# ----------
    obbs my = new obbs();
    Box curr_box2 = curr_box;
    double curr_vol = 4000;
    my.MinBBPlane(objs, ref best_plane, planes, ref curr_box2, ref curr_vol);
    
    A = best_plane;
      B = curr_box2;
    C = curr_vol;
# ---------- c_script_4: C# additional code ----------
  class obbs
  {
    public Box BoundingBoxPlane(List<GeometryBase> objs, Plane plane)
    {
      bool accurate = true;
      Plane wxy_plane = Rhino.Geometry.Plane.WorldXY;
      Transform xform = Rhino.Geometry.Transform.ChangeBasis(wxy_plane, plane);
      BoundingBox bbox = Rhino.Geometry.BoundingBox.Empty;

      foreach (GeometryBase obj in objs)
      {
        BoundingBox objectbbox = Objectbbox(obj, xform, accurate);
        bbox = Rhino.Geometry.BoundingBox.Union(bbox, objectbbox);
      }

      if (bbox.IsValid != true)         //not sure its necessary
      {
        Box emptybox = Rhino.Geometry.Box.Empty;
        return emptybox;
      }

      Transform plane_to_world = Rhino.Geometry.Transform.ChangeBasis(plane, wxy_plane);


      Box box = new Rhino.Geometry.Box(bbox);
      box.Transform(plane_to_world);
      return box;
    }
    public BoundingBox Objectbbox(GeometryBase geom, Transform xform, bool accurate)
    {
      if (geom is Rhino.Geometry.Point)
      {
        Point geompt = (Point) geom;
        Point3d geompt3d = geompt.Location;
        if (xform != null)
        {
          geompt3d = xform * geompt3d;

          BoundingBox geompt3dbbox = new Rhino.Geometry.BoundingBox(geompt3d, geompt3d);
          return geompt3dbbox;
        }
      }

      if (xform != null)
      {
        return geom.GetBoundingBox(xform);
      }
      return geom.GetBoundingBox(accurate);
    }
    public void MinBBPlane(List<GeometryBase> objs, ref Plane best_plane,  List<Plane> planes, ref Box curr_box, ref double curr_vol)
    {

      

      foreach (Plane plane in planes)
      {
        Box bb = BoundingBoxPlane(objs, plane);

        if (bb.Volume < curr_vol)
        {
          curr_vol = bb.Volume;
          best_plane = plane;
          curr_box = bb;
        }

      }

    }


  }
# ---------- end c_script_4 ----------
panel_6 = Panel(c_script_3.A)
panel_7 = Panel(c_script_4.out)
# Min3DBoundingBox
c_script_5 = CSharpScript(
    objs=geo,
    init_plane=xy_2,
    best_plane=xy_2,
    planes=rotate_2.Geometry,
    count=number_slider,
    curr_box=bbox_2.Box,
    rel_stop=toggle,
    im_rep=toggle_2)  # -> out, A, B, C; inputs objs: list of GeometryBase, init_plane: Plane, best_plane: Plane, planes: list of Plane, count: Int32, curr_box: Box, rel_stop: Boolean, im_rep: Boolean
# ---------- c_script_5: C# ----------
    obbs my = new obbs();
    Box curr_bb = curr_box;
    double curr_vol = 4000;
    int passes = 20;

    my.Min3DBoundingBox(objs, init_plane, count, rel_stop, im_rep, out  curr_bb, out  curr_vol, out passes);
    A = curr_bb;
    B = curr_vol;
    C = curr_vol;
# ---------- c_script_5: C# additional code ----------
  class obbs
  {
    public List<Plane> RotatedPlaneArray(Plane plane, double tot_ang, int divs, Vector3d axis)
    {
      List<Plane> out_plane = new List<Plane>();
      plane.Rotate(-tot_ang * 0.5, axis);
      out_plane.Add(new Rhino.Geometry.Plane(plane));
      double inc = tot_ang / (divs - 1);
      for(int i = 0; i < divs - 1; i++)
      {
        plane.Rotate(inc, axis);
        out_plane.Add(new Rhino.Geometry.Plane(plane));
      }
      return out_plane;
    }

    public List<Plane> RotatePlaneArray3D(Plane view_plane, double tot_ang, int divs)
    {
      //generate a 3D array of refinement planes (works with narrow angles)
      List<Plane> out_planes = new List<Plane>();
      //use RotatedPlaneArray to generate 'horizontal' left-right array (yaw)
      List<Plane> yaw_planes = RotatedPlaneArray(view_plane, tot_ang, divs, view_plane.ZAxis);
      foreach (Plane y_plane in yaw_planes)
      {
        //use RotatedPlaneArray to generate up-down 'tilt' array(roll)
        List<Plane> roll_planes = RotatedPlaneArray(y_plane, tot_ang, divs, y_plane.YAxis);

        foreach (Plane r_plane in roll_planes)
        {
          //use RotatedPlaneArray to generate up-down 'tilt' array(pitch)
          List<Plane> pitch_planes = RotatedPlaneArray(r_plane, tot_ang, divs, r_plane.XAxis);

          foreach (Plane p_plane in pitch_planes)
          {
            out_planes.Add(p_plane);
          }

        }
      }
      return out_planes;
    }
    public List<Plane> GenerateOctantPlane(int count)
    {
      double tot_ang = Math.PI * 0.5;
      // generates an array of count^3 planes in 3 axes covering xyz positive octant
      Plane yz_plane = Rhino.Geometry.Plane.WorldYZ;
      List<Plane> yz_planelist = new List<Plane>();
      yz_planelist.Add(yz_plane);
      Vector3d Xdir_vec = new Rhino.Geometry.Vector3d(1, 0, 0); //X axis
      List<Plane> x_planes = RotateCopyPlanes(tot_ang, count, yz_planelist, Xdir_vec);


      Vector3d Ydir_vec = new Rhino.Geometry.Vector3d(0, -1, 0); //-Y axis
      List<Plane> xy_planes = RotateCopyPlanes(tot_ang, count, x_planes, Ydir_vec);

      Vector3d Zdir_vec = new Rhino.Geometry.Vector3d(0, 0, 1); //Z axis
      List<Plane> xyz_planes = RotateCopyPlanes(tot_ang, count, xy_planes, Zdir_vec);

      return xyz_planes;

    }
    public List<Plane> RotateCopyPlanes(double tot_ang, int count, List<Plane> init_planes, Vector3d dir_vec)
    {
      double inc = tot_ang / (count - 1);
      Point3d origin = new Rhino.Geometry.Point3d(0, 0, 0);
      List<Plane> planes = new List<Plane>();
      for (int i = 0; i < count; i++)
      {
        foreach (Plane init_plane in init_planes)
        {
          Plane new_plane = new Rhino.Geometry.Plane(init_plane);
          new_plane.Rotate(inc * i, dir_vec, origin);
          planes.Add(new_plane);
        }
      }
      return planes;
    }
    public Box BoundingBoxPlane(List<GeometryBase> objs, Plane plane)
    {
      bool accurate = true;
      Plane wxy_plane = Rhino.Geometry.Plane.WorldXY;
      Transform xform = Rhino.Geometry.Transform.ChangeBasis(wxy_plane, plane);
      BoundingBox bbox = Rhino.Geometry.BoundingBox.Empty;

      foreach (GeometryBase obj in objs)
      {
        BoundingBox objectbbox = Objectbbox(obj, xform, accurate);
        bbox = Rhino.Geometry.BoundingBox.Union(bbox, objectbbox);
      }

      if (bbox.IsValid != true)         //not sure its necessary
      {
        Box emptybox = Rhino.Geometry.Box.Empty;
        return emptybox;
      }

      Transform plane_to_world = Rhino.Geometry.Transform.ChangeBasis(plane, wxy_plane);


      Box box = new Rhino.Geometry.Box(bbox);
      box.Transform(plane_to_world);
      return box;
    }
    public BoundingBox Objectbbox(GeometryBase geom, Transform xform, bool accurate)
    {
      if (geom is Rhino.Geometry.Point)
      {
        Point geompt = (Point) geom;
        Point3d geompt3d = geompt.Location;
        if (xform != null)
        {
          geompt3d = xform * geompt3d;

          BoundingBox geompt3dbbox = new Rhino.Geometry.BoundingBox(geompt3d, geompt3d);
          return geompt3dbbox;
        }
      }

      if (xform != null)
      {
        return geom.GetBoundingBox(xform);
      }
      return geom.GetBoundingBox(accurate);
    }
    public void MinBBPlane(List<GeometryBase> objs, ref Plane best_plane, List<Plane> planes, ref Box curr_box, ref double curr_vol)
    {



      foreach (Plane plane in planes)
      {
        Box bb = BoundingBoxPlane(objs, plane);

        if (bb.Volume < curr_vol)
        {
          curr_vol = bb.Volume;
          best_plane = plane;
          curr_box = bb;
        }

      }

    }
    public void Min3DBoundingBox(List<GeometryBase> objs, Plane init_plane, int count, bool rel_stop, bool im_rep, out Box curr_bb, out double curr_vol, out int passes)
    {
      // for non-planar or non-coplanar object(s)
      // get initial fast bb in init plane (World XY), plus volume to compare
      //this is the main 2D bb calculation search function

      curr_bb = BoundingBoxPlane(objs, init_plane);

      curr_vol = curr_bb.Volume;

      double tot_ang = Math.PI * 0.5;  //90 degrees for intial octant
      double factor = 0.1; //angle reduction factor for each successive refinement pass
      int max_passes = 20; //safety factor
      int prec = Rhino.RhinoDoc.ActiveDoc.DistanceDisplayPrecision;
      string us = Rhino.RhinoDoc.ActiveDoc.GetUnitSystemName(true, false, false, false);

      //run intitial bb calculation
      List<Plane> xyz_planes = GenerateOctantPlane(count);
      Plane best_plane = new Plane();
      MinBBPlane(objs, ref best_plane, xyz_planes, ref curr_bb, ref curr_vol);
      //report the results of intial rough calculation
      if (im_rep == true)
      {
        ;
      }
      //refine with smaller angles arround best fit plane, loop until...
      int i = 0;
      for(i = 0; i < max_passes; i++)
      {
        double prev_vol = curr_vol;

        //reduce angle by factor, use refinement planes to generate array

        tot_ang *= factor;
        List <Plane> ref_planes = RotatePlaneArray3D(best_plane, tot_ang, count);
        MinBBPlane(objs, ref best_plane, ref_planes, ref curr_bb, ref curr_vol);
        double vol_diff = prev_vol - curr_vol;//vol. diff. over last pass, should be positive or 0
        // print "Volume difference from last pass: {}".format(vol_diff) #debug(python language)
        // check if difference is less than minimum "significant"
        // rel_stop==True: relative stop value <.01% difference from previous

        if (rel_stop == true)
        {
          if (vol_diff < 0.0001 * prev_vol)
          {
            break;
          }
        }
        else
        {
          RhinoDoc rd = RhinoDoc.ActiveDoc;
          if (vol_diff < rd.ModelAbsoluteTolerance)
          {
            break;
          }
        }
        Rhino.RhinoApp.Wait();

        if (im_rep == true)
        {
          //Console.WriteLine("Refine pass {0}, volume:{1} {2}3", i + 1, Math.Round(curr_vol, prec), us);
        }

        //get out of loop if escape is pressed

        //if (Console.ReadKey().Key != ConsoleKey.Escape)
        //{
          //Console.WriteLine("Refinement aborted after {0} passes", i + 1);
         // break;
        //}
      }
      passes = i + 1;


    }

  }
# ---------- end c_script_5 ----------
geo_5 = Geometry([<curve referenced from the Rhino model>, <brep referenced from the Rhino model> x2])
# join message
c_script_6 = CSharpScript()  # -> out, A, B, C
# ---------- c_script_6: C# ----------
    List<string> aaa = new List<string>();
    List<string> bbb = new List<string>();
    List<string> ccc = new List<string>();
    
    aaa.Add("1");
    aaa.Add("2");
    aaa.Add("3");
    bbb.Add("a");
    bbb.Add("b");
    bbb.Add("c");
    
  
    foreach (string x in bbb)
    {
      aaa.Add(x);
    }
    A = aaa;
# ---------- end c_script_6 ----------
panel_8 = Panel(c_script_5.out)
geo_6 = Geometry([<curve referenced from the Rhino model> x2])
# checkcoplanarity
geo_7 = Geometry(<curve referenced from the Rhino model>)
c_script_7 = CSharpScript(objs=geo_5, fine_sample=Slider(10, range=0..10))  # -> out, A, B, C; inputs objs: list of GeometryBase, fine_sample: Int32
# ---------- c_script_7: C# ----------
    List<string> msg = new List<string>();
    Box bb = new Box();

    obbs my = new obbs();
    my.CombinedMinBBMulti(objs, fine_sample, out msg, out bb);
    A = bb;
    B = msg;
# ---------- c_script_7: C# additional code ----------
  class obbs
  {
    public BoundingBox Objectbbox(GeometryBase geom, Transform xform, bool accurate)
    {
      if (geom is Rhino.Geometry.Point)
      {
        Point geompt = (Point) geom;
        Point3d geompt3d = geompt.Location;
        if (xform != null)
        {
          geompt3d = xform * geompt3d;

          BoundingBox geompt3dbbox = new Rhino.Geometry.BoundingBox(geompt3d, geompt3d);
          return geompt3dbbox;
        }
      }

      if (xform != null)
      {
        return geom.GetBoundingBox(xform);
      }
      return geom.GetBoundingBox(accurate);
    }

    public Box BoundingBoxPlane(List<GeometryBase> objs, Plane plane, bool accurate)
    {
      accurate = true;
      Plane wxy_plane = Rhino.Geometry.Plane.WorldXY;
      Transform xform = Rhino.Geometry.Transform.ChangeBasis(wxy_plane, plane);
      BoundingBox bbox = Rhino.Geometry.BoundingBox.Empty;

      foreach (GeometryBase obj in objs)
      {
        BoundingBox objectbbox = Objectbbox(obj, xform, accurate);
        bbox = Rhino.Geometry.BoundingBox.Union(bbox, objectbbox);
      }

      if (bbox.IsValid != true)         //not sure its necessary
      {
        Box emptybox = Rhino.Geometry.Box.Empty;
        return emptybox;
      }

      Transform plane_to_world = Rhino.Geometry.Transform.ChangeBasis(plane, wxy_plane);


      Box box = new Rhino.Geometry.Box(bbox);
      box.Transform(plane_to_world);
      return box;
    }

    public double BoxArea(Box box)
    {
      return (box.X[1] - box.X[0]) * (box.Y[1] - box.Y[0]);
    }


    public void PlanarMinBB(List<GeometryBase> objs, Plane plane, double tot_ang, int divs, out Plane curr_plane, out double curr_area)
    {
      double inc = tot_ang / divs;
      //rotate plane half total angle minus direction
      plane.Rotate(-tot_ang * 0.5, plane.ZAxis, plane.Origin);
      Box bb = BoundingBoxPlane(objs, plane, true);
      curr_plane = new Plane(plane);
      curr_area = BoxArea(bb);
      //loop through angle increments
      for(int i = 0; i < divs; i++)
      {
        plane.Rotate(inc, plane.ZAxis, plane.Origin);
        bb = BoundingBoxPlane(objs, plane, true);
        double new_area = BoxArea(bb);
        if (new_area < curr_area)
        {
          curr_area = new_area;
          curr_plane = plane;
        }
      }


    }

    public void MinBoundingRectanglePlane(List<GeometryBase> objs, Plane curr_plane, out Box f_bb, out Double curr_area, out int i)
    {
      //pass True argument above if you want to print intermediate results
      //initialize
      double factor = 0.01;  //0.01 (1/100 of model abs tolerance)
      double angle = Math.PI * 0.5; //start angle 90 degrees
      int divs = 90;  //initial division 1 degree intervals
      RhinoDoc rd = RhinoDoc.ActiveDoc;
      double tol = rd.ModelAbsoluteTolerance;
      List<string> insidemsg = new List<string>();
      string err_msg = "Unable to calculate bouding box area";
      bool im_rep = false;
      f_bb = new Box();
      i = 0;
      DateTime dt = System.DateTime.Now;
      DateTime st = TimeZone.CurrentTimeZone.ToLocalTime(new DateTime(1970, 1, 1));
      double stime = (dt - st).TotalMilliseconds;

      ///get initial rough bounding box

      Box init_bb = BoundingBoxPlane(objs, curr_plane, false);
      curr_area = BoxArea(init_bb);
      if (im_rep == true)
      {
        Console.WriteLine("Initial area: {}", curr_area);
      }

      //main calculation loop
      int safe = 10;
      for (i = 0; i < safe; i++)
      {

        PlanarMinBB(objs, curr_plane, angle, divs, out curr_plane, out curr_area);
        double new_area = curr_area;
        //abort if area is 0 or extremly small
        if (new_area < tol * 0.1)
        {
          Console.WriteLine(err_msg);
          return;
        }
        //break out of loop if new area is the smae as prev. area within limit
        if (Math.Abs(curr_area - new_area) < factor * tol)
        {
          break;
        }
        //otherwise,decrease increments and loop
        curr_area = new_area;
        angle *= (1 / divs);
        if(im_rep == true)
        {
          Console.WriteLine("Refine stage {0} Area: {1}", i + 1, curr_area);
          Rhino.RhinoApp.Wait();//wait for command line to print...
        }
        if (i == 10)
        {
          Console.WriteLine("Max loop limit reached");//debug
        }
      }

      f_bb = BoundingBoxPlane(objs, curr_plane, true);


    }

    public Plane CheckObjCoPlanarity(List<GeometryBase> objs)
    {
      List<Point3d> ptlist = new List<Point3d>();
      Plane myplane = new Plane();
      bool myresult = new bool();

      RhinoDoc rd = RhinoDoc.ActiveDoc;
      double tol = rd.ModelAbsoluteTolerance;
      foreach (var obj in objs)
      {
        if (obj is Rhino.Geometry.Curve)
        {
          Curve objcurve = (Curve) obj;
          myresult = objcurve.TryGetPlane(out myplane, tol);

          // if (myresult != false)
          //{
          //   myplane = default(Plane);
          //  return myplane;
          // }

          NurbsCurve mynurbscurve = objcurve.ToNurbsCurve();

          if (mynurbscurve == default(NurbsCurve))
          {
            myplane = default(Plane);
            return myplane;
          }

          for (int i = 0; i < mynurbscurve.Points.Count; i = i + 1)
          {

            ptlist.Add(mynurbscurve.Points[i].Location);

          }

        }

        else if (obj is Rhino.Geometry.Point)
        {
          Point objpoint = (Point) obj;
          ptlist.Add(objpoint.Location);

        }

        else if (obj is Rhino.Geometry.PointCloud)
        {
          PointCloud objpointcloud = (PointCloud) obj;
          Point3d[] ptarray = objpointcloud.GetPoints();
          foreach (Point3d i in ptarray)
          {
            ptlist.Add(i);
          }

        }

        else if (obj is Rhino.Geometry.Brep)
        {
          Brep objbrep = (Brep) obj;
          foreach (BrepFace face in objbrep.Faces)
          {
            myresult = face.TryGetPlane(out myplane, tol);

            //if (myresult != false)
            //{
              //myplane = default(Plane);
              //return myplane;
            //}
            NurbsSurface mysurfaceface = face.ToNurbsSurface();

            if (mysurfaceface == default(NurbsSurface))
            {
              myplane = default(Plane);
              return myplane;
            }

            foreach (ControlPoint cp in mysurfaceface.Points)
            {
              ptlist.Add(cp.Location);
            }

          }
        }

        else if (obj is Rhino.Geometry.Surface)
        {
          Surface objsurface = (Surface) obj;
          myresult = objsurface.TryGetPlane(out myplane, tol);
          if (myresult != false)
          {
            myplane = default(Plane);
            return myplane;
          }

          NurbsSurface mysurfaceface = objsurface.ToNurbsSurface();

          if (mysurfaceface == default(NurbsSurface))
          {
            myplane = default(Plane);
            return myplane;
          }


          foreach (ControlPoint cp in mysurfaceface.Points)
          {
            ptlist.Add(cp.Location);
          }



        }

        else if (obj is Rhino.Geometry.Extrusion)
        {
          Extrusion objextrusion = (Extrusion) obj;
          myresult = objextrusion.TryGetPlane(out myplane, tol);
          if (myresult != false)
          {
            myplane = default(Plane);
            return myplane;
          }

          NurbsSurface mysurfaceface = objextrusion.ToNurbsSurface();
          if (mysurfaceface == default(NurbsSurface))
          {
            myplane = default(Plane);
            return myplane;
          }
          foreach (ControlPoint cp in mysurfaceface.Points)
          {
            ptlist.Add(cp.Location);
          }

        }

        else if (obj is Rhino.Geometry.Mesh)
        {
          Mesh objmesh = (Mesh) obj;
          foreach (Point3d vert in objmesh.Vertices)
          {
            ptlist.Add(vert);

          }

        }

        else
        {
          return myplane;
        }

      }
      Plane.FitPlaneToPoints(ptlist, out myplane);
      return myplane;
    }
    public Box CombinedMinBBMulti(List<GeometryBase> objs, int fine_sample, out List<string> msg, out Box bb)
    {
      msg = new List<string>();
      int prec = Rhino.RhinoDoc.ActiveDoc.DistanceDisplayPrecision;
      string us = Rhino.RhinoDoc.ActiveDoc.GetUnitSystemName(true, false, false, false);

      List<GeometryBase> inputs = objs;
      int count = fine_sample;
      int passes = 0;
      bb = Box.Empty;



      msg.Add("checking object planarity/coplanarity...\r\n");

      DateTime dt = System.DateTime.Now;
      DateTime st = TimeZone.CurrentTimeZone.ToLocalTime(new DateTime(1970, 1, 1));
      double stime = (dt - st).TotalMilliseconds;


      Plane plane = CheckObjCoPlanarity(objs);

      if(plane != null)
      {
        if (objs.Count == 1)
        {
          msg.Add("Selected object is planar -\r\n");
        }
        else
        {
          msg.Add("All selected objects are coplanar - \r\n");
          msg.Add("launching 2D planar bounding rectangle calculation.\r\n");
        }


        //launch planar bounding box routine
        Box f_bb = Box.Empty;
        Point3d[] f_bbpt = Box.Empty.GetCorners();
        double curr_area = 0.0;
        int i = 0;


        MinBoundingRectanglePlane(objs, plane, out f_bb, out curr_area, out i);
        passes = i;


        bb = f_bb;

        double fa = Math.Round(curr_area, prec);


        msg.Add(passes.ToString() + " refinement stages\r\n");
        msg.Add("Minimum bounding box area =" + fa.ToString() + "sq" + us.ToString() + "\r\n");

        //msg += " Elapsed time: {:.2f} sec.".format(time.time() - st);


      }

      else
      {
        // standard sample count=10 --> 1000 boxes per pass
        // fine sample count=18 --> 5832 boxes per pass




        if(objs.Count == 1)
        {
          msg.Add("Selected object is not planar -\r\n");
        }

        else
        {
          msg.Add("Selected object are not planar -\r\n");
        }

        msg.Add("launching 3D bounding box calculation.\r\n");
        double curr_vol = 0.0;
        Plane wxy_plane = Rhino.Geometry.Plane.WorldXY;
        Box curr_bb = Box.Empty;

        Min3DBoundingBox(objs, wxy_plane, count, false, false, out curr_bb, out curr_vol, out passes);

        bb = curr_bb;
        double fv = Math.Round(curr_vol, prec);
        msg.Add("Final volume after" + passes.ToString() + "passes is " + fv.ToString() + us.ToString());
        //msg += " | Elapsed time: {:.2f} sec.".format(time.time() - st)

      }
      return bb;

    }
    public List<Plane> RotatedPlaneArray(Plane plane, double tot_ang, int divs, Vector3d axis)
    {
      List<Plane> out_plane = new List<Plane>();
      plane.Rotate(-tot_ang * 0.5, axis);
      out_plane.Add(new Rhino.Geometry.Plane(plane));
      double inc = tot_ang / (divs - 1);
      for(int i = 0; i < divs - 1; i++)
      {
        plane.Rotate(inc, axis);
        out_plane.Add(new Rhino.Geometry.Plane(plane));
      }
      return out_plane;
    }

    public List<Plane> RotatePlaneArray3D(Plane view_plane, double tot_ang, int divs)
    {
      //generate a 3D array of refinement planes (works with narrow angles)
      List<Plane> out_planes = new List<Plane>();
      //use RotatedPlaneArray to generate 'horizontal' left-right array (yaw)
      List<Plane> yaw_planes = RotatedPlaneArray(view_plane, tot_ang, divs, view_plane.ZAxis);
      foreach (Plane y_plane in yaw_planes)
      {
        //use RotatedPlaneArray to generate up-down 'tilt' array(roll)
        List<Plane> roll_planes = RotatedPlaneArray(y_plane, tot_ang, divs, y_plane.YAxis);

        foreach (Plane r_plane in roll_planes)
        {
          //use RotatedPlaneArray to generate up-down 'tilt' array(pitch)
          List<Plane> pitch_planes = RotatedPlaneArray(r_plane, tot_ang, divs, r_plane.XAxis);

          foreach (Plane p_plane in pitch_planes)
          {
            out_planes.Add(p_plane);
          }

        }
      }
      return out_planes;
    }
    public List<Plane> GenerateOctantPlane(int count)
    {
      double tot_ang = Math.PI * 0.5;
      // generates an array of count^3 planes in 3 axes covering xyz positive octant
      Plane yz_plane = Rhino.Geometry.Plane.WorldYZ;
      List<Plane> yz_planelist = new List<Plane>();
      yz_planelist.Add(yz_plane);
      Vector3d Xdir_vec = new Rhino.Geometry.Vector3d(1, 0, 0); //X axis
      List<Plane> x_planes = RotateCopyPlanes(tot_ang, count, yz_planelist, Xdir_vec);


      Vector3d Ydir_vec = new Rhino.Geometry.Vector3d(0, -1, 0); //-Y axis
      List<Plane> xy_planes = RotateCopyPlanes(tot_ang, count, x_planes, Ydir_vec);

      Vector3d Zdir_vec = new Rhino.Geometry.Vector3d(0, 0, 1); //Z axis
      List<Plane> xyz_planes = RotateCopyPlanes(tot_ang, count, xy_planes, Zdir_vec);

      return xyz_planes;

    }
    public List<Plane> RotateCopyPlanes(double tot_ang, int count, List<Plane> init_planes, Vector3d dir_vec)
    {
      double inc = tot_ang / (count - 1);
      Point3d origin = new Rhino.Geometry.Point3d(0, 0, 0);
      List<Plane> planes = new List<Plane>();
      for (int i = 0; i < count; i++)
      {
        foreach (Plane init_plane in init_planes)
        {
          Plane new_plane = new Rhino.Geometry.Plane(init_plane);
          new_plane.Rotate(inc * i, dir_vec, origin);
          planes.Add(new_plane);
        }
      }
      return planes;
    }
    public Box BoundingBoxPlane(List<GeometryBase> objs, Plane plane)
    {
      bool accurate = true;
      Plane wxy_plane = Rhino.Geometry.Plane.WorldXY;
      Transform xform = Rhino.Geometry.Transform.ChangeBasis(wxy_plane, plane);
      BoundingBox bbox = Rhino.Geometry.BoundingBox.Empty;

      foreach (GeometryBase obj in objs)
      {
        BoundingBox objectbbox = Objectbbox(obj, xform, accurate);
        bbox = Rhino.Geometry.BoundingBox.Union(bbox, objectbbox);
      }

      if (bbox.IsValid != true)         //not sure its necessary
      {
        Box emptybox = Rhino.Geometry.Box.Empty;
        return emptybox;
      }

      Transform plane_to_world = Rhino.Geometry.Transform.ChangeBasis(plane, wxy_plane);


      Box box = new Rhino.Geometry.Box(bbox);
      box.Transform(plane_to_world);
      return box;
    }

    public void MinBBPlane(List<GeometryBase> objs, ref Plane best_plane, List<Plane> planes, ref Box curr_box, ref double curr_vol)
    {



      foreach (Plane plane in planes)
      {
        Box bb = BoundingBoxPlane(objs, plane);

        if (bb.Volume < curr_vol)
        {
          curr_vol = bb.Volume;
          best_plane = plane;
          curr_box = bb;
        }

      }

    }
    public void Min3DBoundingBox(List<GeometryBase> objs, Plane init_plane, int count, bool rel_stop, bool im_rep, out Box curr_bb, out double curr_vol, out int passes)
    {
      // for non-planar or non-coplanar object(s)
      // get initial fast bb in init plane (World XY), plus volume to compare
      //this is the main 2D bb calculation search function

      curr_bb = BoundingBoxPlane(objs, init_plane);

      curr_vol = curr_bb.Volume;

      double tot_ang = Math.PI * 0.5;  //90 degrees for intial octant
      double factor = 0.1; //angle reduction factor for each successive refinement pass
      int max_passes = 20; //safety factor
      int prec = Rhino.RhinoDoc.ActiveDoc.DistanceDisplayPrecision;
      string us = Rhino.RhinoDoc.ActiveDoc.GetUnitSystemName(true, false, false, false);

      //run intitial bb calculation
      List<Plane> xyz_planes = GenerateOctantPlane(count);
      Plane best_plane = new Plane();
      MinBBPlane(objs, ref best_plane, xyz_planes, ref curr_bb, ref curr_vol);
      //report the results of intial rough calculation
      if (im_rep == true)
      {
        ;
      }
      //refine with smaller angles arround best fit plane, loop until...
      int i = 0;
      for(i = 0; i < max_passes; i++)
      {
        double prev_vol = curr_vol;

        //reduce angle by factor, use refinement planes to generate array

        tot_ang *= factor;
        List <Plane> ref_planes = RotatePlaneArray3D(best_plane, tot_ang, count);
        MinBBPlane(objs, ref best_plane, ref_planes, ref curr_bb, ref curr_vol);
        double vol_diff = prev_vol - curr_vol;//vol. diff. over last pass, should be positive or 0
        // print "Volume difference from last pass: {}".format(vol_diff) #debug(python language)
        // check if difference is less than minimum "significant"
        // rel_stop==True: relative stop value <.01% difference from previous

        if (rel_stop == true)
        {
          if (vol_diff < 0.0001 * prev_vol)
          {
            break;
          }
        }
        else
        {
          RhinoDoc rd = RhinoDoc.ActiveDoc;
          if (vol_diff < rd.ModelAbsoluteTolerance)
          {
            break;
          }
        }
        Rhino.RhinoApp.Wait();

        if (im_rep == true)
        {
          //Console.WriteLine("Refine pass {0}, volume:{1} {2}3", i + 1, Math.Round(curr_vol, prec), us);
        }

        //get out of loop if escape is pressed

        //if (Console.ReadKey().Key != ConsoleKey.Escape)
        //{
        //Console.WriteLine("Refinement aborted after {0} passes", i + 1);
        // break;
        //}
      }
      passes = i + 1;


    }

  }
# ---------- end c_script_7 ----------
c_script_8 = CSharpScript(objs=geo_7)  # -> out, A, B; inputs objs: list of GeometryBase
# ---------- c_script_8: C# ----------
    bool myresult = new bool();
    A = CheckObjCoPlanarity(objs, out myresult);
    B = myresult;
# ---------- c_script_8: C# additional code ----------
  public Plane CheckObjCoPlanarity(List<GeometryBase> objs, out bool myresult)
  {
    List<Point3d> ptlist = new List<Point3d>();
    Plane myplane = new Plane();
    myresult = new bool();

    RhinoDoc rd = RhinoDoc.ActiveDoc;
    double tol = rd.ModelAbsoluteTolerance;
    foreach (var obj in objs)
    {
      if (obj is Rhino.Geometry.Curve)
      {
        Curve objcurve = (Curve) obj;
        objcurve.TryGetPlane(out myplane, tol);



        NurbsCurve mynurbscurve = objcurve.ToNurbsCurve();

        if(mynurbscurve == default(NurbsCurve))
        {
          myplane = default(Plane);
          return myplane;
        }

        for (int i = 0; i < mynurbscurve.Points.Count; i = i + 1)
        {

          ptlist.Add(mynurbscurve.Points[i].Location);

        }

      }

      else if (obj is Rhino.Geometry.Point)
      {
        Point objpoint = (Point) obj;
        ptlist.Add(objpoint.Location);

      }

      else if (obj is Rhino.Geometry.PointCloud)
      {
        PointCloud objpointcloud = (PointCloud) obj;
        Point3d[] ptarray = objpointcloud.GetPoints();
        foreach (Point3d i in ptarray)
        {
          ptlist.Add(i);
        }

      }

      else if (obj is Rhino.Geometry.Brep)
      {
        Brep objbrep = (Brep) obj;
        foreach (BrepFace face in objbrep.Faces)
        {
          face.TryGetPlane(out myplane, tol);

          
          NurbsSurface mysurfaceface = face.ToNurbsSurface();

          if (mysurfaceface == default(NurbsSurface))
          {
            myplane = default(Plane);
            return myplane;
          }

          foreach (ControlPoint cp in mysurfaceface.Points)
          {
            ptlist.Add(cp.Location);
          }

        }
      }

      else if (obj is Rhino.Geometry.Surface)
      {
        Surface objsurface = (Surface) obj;
        myresult = objsurface.TryGetPlane(out myplane, tol);
        if (myresult != false)
        {
          myplane = default(Plane);
          return myplane;
        }

        NurbsSurface mysurfaceface = objsurface.ToNurbsSurface();

        if(mysurfaceface == default(NurbsSurface))
        {
          myplane = default(Plane);
          return myplane;
        }


        foreach (ControlPoint cp in mysurfaceface.Points)
        {
          ptlist.Add(cp.Location);
        }



      }

      else if (obj is Rhino.Geometry.Extrusion)
      {
        Extrusion objextrusion = (Extrusion) obj;
        myresult = objextrusion.TryGetPlane(out myplane, tol);
        if (myresult == false)
        {
          myplane = default(Plane);
          return myplane;
        }

        NurbsSurface mysurfaceface = objextrusion.ToNurbsSurface();
        if (mysurfaceface == default(NurbsSurface))
        {
          myplane = default(Plane);
          return myplane;
        }
        foreach (ControlPoint cp in mysurfaceface.Points)
        {
          ptlist.Add(cp.Location);
        }

      }

      else if (obj is Rhino.Geometry.Mesh)
      {
        Mesh objmesh = (Mesh) obj;
        foreach (Point3d vert in objmesh.Vertices)
        {
          ptlist.Add(vert);

        }

      }

      else
      {
        return myplane;
      }

    }
    Plane.FitPlaneToPoints(ptlist, out myplane);
    return myplane;
  }
# ---------- end c_script_8 ----------
panel_9 = Panel(c_script_8.out)
panel_10 = Panel(c_script_8.B)
minbb = MinimumBoundinbBox(G=geo_6, N=Slider(10, range=0..10))  # -> out, BB; inputs G: list of GeometryBase, N: Int32
# ---------- minbb: Python ----------
"""Combined 2D and 3D "fast" minimum bounding box calculator.
Accepts points, pointclouds, curves, surfaces, breps, extrusions, meshes.
Checks first for single object planarity or multi-object coplanarity.
User options for standard/fine sampling and intermediate result reporting
(3D BB only)

If planar/coplanar:
- Launches 2D planar bounding rectangle routine
- Finds a minimum bounding rectangle relative to a plane for a set of objects.
- Finds smallest area rectangle in plane first to 1 degree, then refines by 1/90
- continues looping with smaller increments until area no longer decreases. (tol)

If non planar/coplanar:
- Launches 3D bounding box routine
- Gets initial rough bounding box/plane: checks every 9 or 5 degrees in all 3 axes
- uses plane from previous check as start point for smaller refinements
- continues refnement stages until bounding box area no longer decreases. (tol)

Script by Mitch Heynick 23.06.18  Release version 1
Edit By willemderks 2019 01 16 to allow a single box for each selected object
Edit By dharman gersch 2019 04 11 to work in grasshopper python component.
    Inputs:
        G: list of geometry to get boundinb box
        N: number of samples. 10="Standard", 18="Fine"
        TODO: get bb for each branch to allow bounding boxes of groups of objects

    Output:
        BB: the resulting minimum volume oriented bounding box"""

__author__ = "Mitch Heynick"
__version__ = "2019.04.12"
__url__ = "https://discourse.mcneel.com/t/minimum-oriented-bounding-box-implementation-in-grasshopper-python-script-node/64344"

ghenv.Component.Name = "minimum Boundinb Box"
ghenv.Component.NickName = 'minbb'
ghenv.Component.Message = ''
ghenv.Component.Category = "Geo"
ghenv.Component.SubCategory = "1"

import rhinoscriptsyntax as rs
import scriptcontext as sc
import Rhino, math, time
import Rhino.DocObjects.ObjectType as OT

#get input objects plus settings
#TODO: add grasshopper inputs for command line options
def GetObjectsPlus3Boolean(prompt,b_prompts,b_opts,g_filt=None):
    go = Rhino.Input.Custom.GetObject()
    go.SetCommandPrompt(prompt)
    blnOption0=Rhino.Input.Custom.OptionToggle(*b_opts[0])
    blnOption1=Rhino.Input.Custom.OptionToggle(*b_opts[1])
    blnOption2=Rhino.Input.Custom.OptionToggle(*b_opts[2])
    go.AddOptionToggle(b_prompts[0],blnOption0)
    go.AddOptionToggle(b_prompts[1],blnOption1)
    go.AddOptionToggle(b_prompts[2],blnOption2)
    #allow preselected object
    go.EnablePreSelect(True,True)
    #main object type filter
    if g_filt: go.GeometryFilter=g_filt
    while True:
        get_rc = go.GetMultiple(1,0)
        if get_rc==Rhino.Input.GetResult.Cancel: return
        if get_rc==Rhino.Input.GetResult.Object:
            objs=go.Objects()
            break
        elif get_rc==Rhino.Input.GetResult.Option:
            continue
    a=blnOption0.CurrentValue
    b=blnOption1.CurrentValue
    c=blnOption2.CurrentValue
    return (objs,a,b,c)

#multi-object planarity/coplanarity check function
def CheckObjCoPlanarity(objs,tol=sc.doc.ModelAbsoluteTolerance):
    #accepts points, pointclouds, curves, surfaces, breps and meshes
    #try to "short-circuit" out if any curve or brep element is not planar
    pt_list=[]
    for obj in objs:
        if isinstance(obj,Rhino.Geometry.Point3d):
            pt_list.append(obj)
        elif isinstance(obj,Rhino.Geometry.Point):
            pt_list.append(obj.Location)
        elif isinstance(obj,Rhino.Geometry.PointCloud):
            pt_list.extend(obj.GetPoints())
        elif isinstance(obj,Rhino.Geometry.Curve):
            rc,plane=obj.TryGetPlane(tol)
            if not rc: return
            nc = obj.ToNurbsCurve()
            if nc is None: return
            crv_pts=[nc.Points[i].Location for i in xrange(nc.Points.Count)]
            pt_list.extend(crv_pts)
        elif isinstance(obj,Rhino.Geometry.Brep):
            for face in obj.Faces:
                rc,plane=face.TryGetPlane(tol)
                if not rc: return
                srf=face.ToNurbsSurface()
                if not srf: return
                for cp in srf.Points: pt_list.append(cp.Location)
        elif isinstance(obj,Rhino.Geometry.Surface):
            rc,plane=obj.TryGetPlane(tol)
            if not rc: return
            srf=obj.ToNurbsSurface()
            if not srf: return
            for cp in srf.Points: pt_list.append(cp.Location)
        elif isinstance(obj,Rhino.Geometry.Extrusion):
            rc,plane=obj.TryGetPlane(tol)
            if not rc: return
            srf=face.ToNurbsSurface()
            if not srf: return
            for cp in srf.Points: pt_list.append(cp.Location)
        elif isinstance(obj,Rhino.Geometry.Mesh):
            verts=obj.Vertices
            for vert in obj.Vertices: pt_list.append(Rhino.Geometry.Point3d(vert))
        else:
            return
    if Rhino.Geometry.Point3d.ArePointsCoplanar(pt_list,tol):
        rc, plane = Rhino.Geometry.Plane.FitPlaneToPoints(pt_list)
        if rc==Rhino.Geometry.PlaneFitResult.Success: return plane


#gets a plane-aligned bounding box
def BoundingBoxPlane(objs,plane,ret_pts=False,accurate=True):
    """returns a plane-aligned bounding box in world coordinates
       - input geometry must be RhinoCommon geometry (not IDs)
       - adapted from python rhinoscriptsyntax rs.BoundingBox() code."""
    wxy_plane=Rhino.Geometry.Plane.WorldXY
    def __objectbbox(geom,xform):
        if isinstance(geom,Rhino.Geometry.Point):
            pt=geom.Location
            if xform: pt = xform * pt
            return Rhino.Geometry.BoundingBox(pt,pt)
        if xform: return geom.GetBoundingBox(xform)
        return geom.GetBoundingBox(accurate)
    
    xform = Rhino.Geometry.Transform.ChangeBasis(wxy_plane, plane)
    bbox = Rhino.Geometry.BoundingBox.Empty
    if type(objs) is list or type(objs) is tuple:
        for obj in objs:
            objectbbox = __objectbbox(obj, xform)
            bbox = Rhino.Geometry.BoundingBox.Union(bbox,objectbbox)
    else:
        objectbbox = __objectbbox(objs, xform)
        bbox = Rhino.Geometry.BoundingBox.Union(bbox,objectbbox)
    if not bbox.IsValid: return
    plane_to_world = Rhino.Geometry.Transform.ChangeBasis(plane,wxy_plane)
    if ret_pts:
        corners = list(bbox.GetCorners())
        for pt in corners: pt.Transform(plane_to_world)
        return corners
    else:
        box=Rhino.Geometry.Box(bbox)
        box.Transform(plane_to_world)
        return box

#used in initial 3D bb calculation
def RotateCopyPlanes(tot_ang,count,init_planes,dir_vec):
    """takes a single plane or list of planes as input
    rotates/copies planes through angle tot_ang
    number of planes=count, number of angle divisions=count-1"""
    if isinstance(init_planes,Rhino.Geometry.Plane): init_planes=[init_planes]
    inc=tot_ang/(count-1)
    origin=Rhino.Geometry.Point3d(0,0,0)
    planes=[]
    objs=[]
    for i in range(count):
        for init_plane in init_planes:
            new_plane=Rhino.Geometry.Plane(init_plane)
            new_plane.Rotate(inc*i,dir_vec,origin)
            planes.append(new_plane)
    return planes

#used in initial 3D bb calculation
def GenerateOctantPlanes(count):
    tot_ang=math.pi*0.5 #90 degrees
    #generates an array of count^3 planes in 3 axes covering xyz positive octant
    yz_plane=Rhino.Geometry.Plane.WorldYZ
    dir_vec=Rhino.Geometry.Vector3d(1,0,0) #X axis
    x_planes=RotateCopyPlanes(tot_ang,count,yz_plane,dir_vec)
    dir_vec=Rhino.Geometry.Vector3d(0,-1,0) #-Y axis
    xy_planes=RotateCopyPlanes(tot_ang,count,x_planes,dir_vec)
    dir_vec=Rhino.Geometry.Vector3d(0,0,1) #Z axis
    xyz_planes=RotateCopyPlanes(tot_ang,count,xy_planes,dir_vec)
    return xyz_planes

#used in 3D refinement calculation
def RotatedPlaneArray(plane,tot_ang,divs,axis):
    """creates an array of planes rotated in increments around an axis
    tot_ang=total array inc. angle (rads); divided into divs number of divisions
    included angle is interval from -tot_ang/2 to +tot_ang/2
    number of output planes is divs; number of angle divisions is divs-1 """
    out_planes=[]
    plane.Rotate(-tot_ang*0.5,axis)
    out_planes.append(Rhino.Geometry.Plane(plane))
    inc=tot_ang/(divs-1)
    for i in range(divs-1):
        plane.Rotate(inc,axis)
        out_planes.append(Rhino.Geometry.Plane(plane))
    return out_planes

#used in 3D refinement calculation 
def RotatePlaneArray3D(view_plane,tot_ang,divs):
    #generate a 3D array of refinement planes (works with narrow angles)
    out_planes=[]
    #use RotatedPlaneArray to generate 'horizontal' left-right array (yaw)
    yaw_planes=RotatedPlaneArray(view_plane,tot_ang,divs,view_plane.ZAxis)
    for y_plane in yaw_planes:
        #use RotatedPlaneArray to generate side-to-side 'tilt' array (roll)
        roll_planes=RotatedPlaneArray(y_plane,tot_ang,divs,y_plane.YAxis)
        for r_plane in roll_planes:
            #use RotatedPlaneArray to generate up-down 'tilt' array (pitch)
            pitch_planes=RotatedPlaneArray(r_plane,tot_ang,divs,r_plane.XAxis)
            for p_plane in pitch_planes:
                out_planes.append(p_plane)
    return out_planes

#this is the main 3D bb calculation search function
def MinBBPlane(objs,best_plane,planes,curr_box,curr_vol):
    """returns plane with smallest aligned bounding box volume
    from list of input objects, planes to test and initial compare volume
    best plane, volume, and bbox pass through if no better solution found"""
    for plane in planes:
        bb=BoundingBoxPlane(objs,plane,ret_pts=False)
        if bb.Volume<curr_vol:
            curr_vol=bb.Volume
            best_plane=plane
            curr_box=bb
    return best_plane,curr_box,curr_vol

#3D (non-planar) bounding box routine
def Min3DBoundingBox(objs,init_plane,count,rel_stop,im_rep):
    #for non-planar or non-coplanar object(s)
    #get initial fast bb in init plane (World XY), plus volume to compare
    curr_bb=BoundingBoxPlane(objs,init_plane,False)
    curr_vol=curr_bb.Volume
    
    tot_ang=math.pi*0.5 #90 degrees for intial octant
    factor=0.1 #angle reduction factor for each successive refinement pass
    max_passes=20 #safety factor
    prec=Rhino.RhinoDoc.ActiveDoc.DistanceDisplayPrecision
    us=Rhino.RhinoDoc.ActiveDoc.GetUnitSystemName(True, False, False, False)
    
    #run intitial bb calculation
    xyz_planes=GenerateOctantPlanes(count)
    best_plane,curr_bb,curr_vol=MinBBPlane(objs,init_plane,xyz_planes,curr_bb,curr_vol)
    #report results of intial rough calculation
    if im_rep:
        print "Initial pass 0, volume: {} {}3".format(round(curr_vol,prec),us)
    #refine with smaller angles around best fit plane, loop until...
    for i in range(max_passes):
        prev_vol=curr_vol
        #reduce angle by factor, use refinement planes to generate array
        tot_ang*=factor
        ref_planes=RotatePlaneArray3D(best_plane,tot_ang,count)
        best_plane,curr_bb,curr_vol=MinBBPlane(objs,best_plane,ref_planes,curr_bb,curr_vol)
        vol_diff=prev_vol-curr_vol #vol. diff. over last pass, should be positive or 0
        #print "Volume difference from last pass: {}".format(vol_diff) #debug
        #check if difference is less than minimum "significant"
        #rel_stop==True: relative stop value <.01% difference from previous
        if rel_stop:
            if vol_diff<0.0001*prev_vol: break
        else:
            if vol_diff<sc.doc.ModelAbsoluteTolerance: break
        Rhino.RhinoApp.Wait()
        if im_rep:
            print "Refine pass {}, volume: {} {}3".format(i+1,round(curr_vol,prec),us)
        #get out of loop if escape is pressed
        if sc.escape_test(False):
            print "Refinement aborted after {} passes.".format(i+1)
            break
            
    return curr_bb,curr_vol,i+1

#this is the main 2D bb calculation search function
def PlanarMinBB(objs,plane,tot_ang,divs):
    inc=tot_ang/divs
    #rotate plane half total angle minus direction
    plane.Rotate(-tot_ang*0.5,plane.ZAxis,plane.Origin)
    bb = BoundingBoxPlane(objs,plane)
    curr_plane=Rhino.Geometry.Plane(plane)
    curr_area=BoxArea(bb)
    #loop through angle increments
    for i in range(divs):
        plane.Rotate(inc,plane.ZAxis,plane.Origin)
        bb = BoundingBoxPlane(objs,plane)
        new_area=BoxArea(bb)
        if new_area<curr_area:
            #print curr_area #debug
            #print new_area #debug
            curr_area=new_area
            curr_plane=Rhino.Geometry.Plane(plane)
    return curr_plane, curr_area

#2D planar bounding rectangle routine
def MinBoundingRectanglePlane(objs,curr_plane,im_rep=False):
    #pass True argument above if you want to print intermediate results
    #initialize
    factor=0.01 #0.01 (1/100 of model abs tolerance)
    angle=math.pi*0.5 #start angle 90 degrees
    divs=90  #initial division 1 degree intervals
    tol = sc.doc.ModelAbsoluteTolerance
    err_msg="Unable to calculate bounding box area"
    st=time.time()
    
    #get initial rough bounding box
    init_bb=BoundingBoxPlane(objs,curr_plane,ret_pts=False)
    curr_area=BoxArea(init_bb)
    if im_rep: print "Initial area: {}".format(curr_area)
    
    #main calculation loop
    safe=10 #set safety limit at 10
    for i in range(safe):
        curr_plane,new_area = PlanarMinBB(objs,curr_plane,angle,divs)
        #abort if area is 0 or extremely small
        if new_area<tol*0.1:
            print err_msg ; return
        #break out of loop if new area is the same as prev. area within limit
        if abs(curr_area-new_area)<factor*tol: break
        #otherwise, decrease increments and loop
        curr_area=new_area
        angle*=(1/divs)
        if im_rep:
            print "Refine stage {} Area: {}".format(i+1,curr_area)
            Rhino.RhinoApp.Wait() #wait for command line to print...
        if i==10: print "Max loop limit reached" #debug
        
    f_bb=BoundingBoxPlane(objs,curr_plane,ret_pts=True)
    return f_bb,curr_area,i

#used for planar bounding rectangle calculation
def BoxArea(box):
    return (box.X[1]-box.X[0])*(box.Y[1]-box.Y[0])


def CombinedMinBBMulti():
    #user input
    #get prev settings
    if "MinBBSample" in sc.sticky: u_samp = sc.sticky["MinBBSample"]
    else: u_samp = False #standard sampling
    if "MinBBStop" in sc.sticky: u_stop = sc.sticky["MinBBStop"]
    else: u_stop = True #relative volume stop value
    if "MinBBReports" in sc.sticky: u_rep = sc.sticky["MinBBReports"]
    else: u_rep = True #intermediate reports shown
    
    #prec=Rhino.RhinoDoc.ActiveDoc.DistanceDisplayPrecision
    prec = Rhino.RhinoDoc.ActiveDoc.DistanceDisplayPrecision
    #us=Rhino.RhinoDoc.ActiveDoc.GetUnitSystemName(True, False, False, False)
    us = Rhino.RhinoDoc.ActiveDoc.GetUnitSystemName(True, False, False, False)
    
    prompt="Select objects for minimum bounding box"
    gf=OT.Point|OT.PointSet|OT.Curve|OT.Surface|OT.Extrusion|OT.Brep|OT.Mesh
    bool_prompts=["Sampling","StopVal","ReportIntermedResults"]
    bool_ini=[[u_samp,"Standard","Fine"],[u_stop,"Absolute","Relative"],[u_rep,"No","Yes"]]
    #result=GetObjectsPlus3Boolean(prompt,bool_prompts,bool_ini,gf)
    inputs = G, False, False, False

    if inputs is None: return
    objIDs, fine_sample, rel_stop, im_rep= inputs
    

    #EDIT by willemderks to find bbox for each object individually
    
    bb = []
    
    for objID in objIDs:
        
        objs=[rs.coercegeometry(objID)]

        print "Checking object planarity/coplanarity..."
        st=time.time()
        plane=CheckObjCoPlanarity(objs,tol=sc.doc.ModelAbsoluteTolerance)
        
        if plane:
            if len(objs)==1: msg="Selected object is planar - "
            else: msg="All selected objects are coplanar - "
            msg+="launching 2D planar bounding rectangle calculation."
            print msg
            #launch planar bounding box routine
            f_bb,curr_area,passes=MinBoundingRectanglePlane(objs,plane,im_rep)
            
            #add polyline, report message
            #bbID=rs.AddPolyline([f_bb[0],f_bb[1],f_bb[2],f_bb[3],f_bb[0]])
            
            bb.append(Rhino.Geometry.Brep.CreateFromCornerPoints(f_bb[0],f_bb[1],f_bb[2],f_bb[3], 0.1))
            print ("k{}".format(f_bb))

            fa=round(curr_area,prec)
            msg="{} refinement stages. ".format(passes)
            msg+="Minimum bounding box area = {} sq. {}".format(fa,us)
            msg+=" Elapsed time: {:.2f} sec.".format(time.time()-st)
            
        else:
            B=plane;
            #standard sample count=10 --> 1000 boxes per pass
            #fine sample count=18 --> 5832 boxes per pass
            if fine_sample: count=18
            else: count=10
            
            count = N
            wxy_plane=Rhino.Geometry.Plane.WorldXY
            if len(objs)==1: cp_msg="Selected object is not planar - "
            else: cp_msg="Selected objects are not coplanar - "
            cp_msg+="launching 3D bounding box calculation."
            print cp_msg
            #rs.Prompt("Calculating... please wait.")
            #launch 3D bounding box routine
            curr_bb,curr_vol,passes=Min3DBoundingBox(objs,wxy_plane,count,rel_stop,im_rep)
            
            #add box, report message
            if Rhino.RhinoApp.ExeVersion<6:
                #sc.doc.Objects.AddBrep(curr_bb.ToBrep()) #legacy
                bb.append(curr_bb.ToBrep())
            else:
                #sc.doc.Objects.AddBox(curr_bb)
                bb.append(curr_bb)
            fv=round(curr_vol,prec)
            msg="Final volume after {} passes is {} {}3".format(passes,fv,us)
            msg+=" | Elapsed time: {:.2f} sec.".format(time.time()-st)
            
        #final result reporting
        print msg
        
        
        #sc.doc.Views.Redraw()
    #save user settings
    #sc.sticky["MinBBSample"] = fine_sample
    #sc.sticky["MinBBReports"] = im_rep
    #sc.sticky["MinBBStop"] = rel_stop
    return bb


BB = CombinedMinBBMulti()
# ---------- end minbb ----------
c_script_9 = CSharpScript()  # -> out, A
# ---------- c_script_9: C# ----------
    int i = 1;
    
    string a = i.tostring() + "fk";
    A = a;
# ---------- end c_script_9 ----------
panel_11 = Panel(c_script_8.A)
panel_12 = Panel(c_script_9.out)
panel_13 = Panel(c_script_7.out)
item = ListItem(List=minbb.BB, Index=0, Wrap=True)
panel_14 = Panel(c_script_7.B)
# checkcoplanarity
geo_8 = Geometry(<brep referenced from the Rhino model>)
c_script_10 = CSharpScript(objs=geo_8)  # -> out, A, B; inputs objs: list of GeometryBase
# ---------- c_script_10: C# ----------
    bool myresult = new bool();
    Plane OUTCOME = CheckObjCoPlanarity(objs);
    A = OUTCOME;
    B = myresult;
    Plane testplane = default(Plane);
    if (OUTCOME == testplane)
    {
      Print ("yes");
    }
# ---------- c_script_10: C# additional code ----------
  public Plane CheckObjCoPlanarity(List<GeometryBase> objs)
  {
    List<Point3d> ptlist = new List<Point3d>();
    Plane myplane = new Plane();
    bool myresult = new bool();
    RhinoDoc rd = RhinoDoc.ActiveDoc;
    double tol = rd.ModelAbsoluteTolerance;
    foreach (var obj in objs)
    {
      if (obj is Rhino.Geometry.Curve)
      {
        Curve objcurve = (Curve) obj;
        myresult = objcurve.TryGetPlane(out myplane, tol);

        if (myresult == false)
        {
          myplane = default(Plane);
          return myplane;
        }

        NurbsCurve mynurbscurve = objcurve.ToNurbsCurve();

        if(mynurbscurve == default(NurbsCurve))
        {
          myplane = default(Plane);
          return myplane;
        }

        for (int i = 0; i < mynurbscurve.Points.Count; i = i + 1)
        {

          ptlist.Add(mynurbscurve.Points[i].Location);

        }

      }

      else if (obj is Rhino.Geometry.Point)
      {
        Point objpoint = (Point) obj;
        ptlist.Add(objpoint.Location);

      }

      else if (obj is Rhino.Geometry.PointCloud)
      {
        PointCloud objpointcloud = (PointCloud) obj;
        Point3d[] ptarray = objpointcloud.GetPoints();
        foreach (Point3d i in ptarray)
        {
          ptlist.Add(i);
        }

      }

      else if (obj is Rhino.Geometry.Brep)
      {
        Brep objbrep = (Brep) obj;
        foreach (BrepFace face in objbrep.Faces)
        {
          myresult = face.TryGetPlane(out myplane, tol);

          if (myresult == false)
          {
            myplane = default(Plane);
            return myplane;
          }
          NurbsSurface mysurfaceface = face.ToNurbsSurface();

          if (mysurfaceface == default(NurbsSurface))
          {
            myplane = default(Plane);
            return myplane;
          }

          foreach (ControlPoint cp in mysurfaceface.Points)
          {
            ptlist.Add(cp.Location);
          }

        }
      }

      else if (obj is Rhino.Geometry.Surface)
      {
        Surface objsurface = (Surface) obj;
        myresult = objsurface.TryGetPlane(out myplane, tol);
        if (myresult == false)
        {
          myplane = default(Plane);
          return myplane;
        }

        NurbsSurface mysurfaceface = objsurface.ToNurbsSurface();

        if(mysurfaceface == default(NurbsSurface))
        {
          myplane = default(Plane);
          return myplane;
        }


        foreach (ControlPoint cp in mysurfaceface.Points)
        {
          ptlist.Add(cp.Location);
        }



      }

      else if (obj is Rhino.Geometry.Extrusion)
      {
        Extrusion objextrusion = (Extrusion) obj;
        myresult = objextrusion.TryGetPlane(out myplane, tol);
        if (myresult == false)
        {
          myplane = default(Plane);
          return myplane;
        }

        NurbsSurface mysurfaceface = objextrusion.ToNurbsSurface();
        if (mysurfaceface == default(NurbsSurface))
        {
          myplane = default(Plane);
          return myplane;
        }
        foreach (ControlPoint cp in mysurfaceface.Points)
        {
          ptlist.Add(cp.Location);
        }

      }

      else if (obj is Rhino.Geometry.Mesh)
      {
        Mesh objmesh = (Mesh) obj;
        foreach (Point3d vert in objmesh.Vertices)
        {
          ptlist.Add(vert);

        }

      }

      else
      {
        return myplane;
      }

    }
    Plane.FitPlaneToPoints(ptlist, out myplane);
    return myplane;
  }
# ---------- end c_script_10 ----------
panel_15 = Panel(c_script_10.out)
panel_16 = Panel(c_script_10.B)
panel_17 = Panel(c_script_10.A)
geo_9 = Geometry(<curve referenced from the Rhino model>)
c_script_11 = CSharpScript(objs=geo_9, N=Slider(10, range=0..10), im_rep=Toggle(False))  # -> out, A, B; inputs objs: list of GeometryBase, N: Int32, im_rep: Boolean
# ---------- c_script_11: C# ----------
    List<string> msg = new List<string>();
    Box bb = new Box();

    obbs my = new obbs();
    my.CombinedMinBBMulti(objs, N, im_rep, out msg, out bb);
    A = bb;
    B = msg;
# ---------- c_script_11: C# additional code ----------
  class obbs
  {
    public BoundingBox Objectbbox(GeometryBase geom, Transform xform, bool accurate)
    {
      if (geom is Rhino.Geometry.Point)
      {
        Point geompt = (Point) geom;
        Point3d geompt3d = geompt.Location;
        if (xform != null)
        {
          geompt3d = xform * geompt3d;

          BoundingBox geompt3dbbox = new Rhino.Geometry.BoundingBox(geompt3d, geompt3d);
          return geompt3dbbox;
        }
      }

      if (xform != null)
      {
        return geom.GetBoundingBox(xform);
      }
      return geom.GetBoundingBox(accurate);
    }

    public Box BoundingBoxPlane(List<GeometryBase> objs, Plane plane, bool accurate)
    {
      accurate = true;
      Plane wxy_plane = Rhino.Geometry.Plane.WorldXY;
      Transform xform = Rhino.Geometry.Transform.ChangeBasis(wxy_plane, plane);
      BoundingBox bbox = Rhino.Geometry.BoundingBox.Empty;

      foreach (GeometryBase obj in objs)
      {
        BoundingBox objectbbox = Objectbbox(obj, xform, accurate);
        bbox = Rhino.Geometry.BoundingBox.Union(bbox, objectbbox);
      }

      if (bbox.IsValid != true)         //not sure its necessary
      {
        Box emptybox = Rhino.Geometry.Box.Empty;
        return emptybox;
      }

      Transform plane_to_world = Rhino.Geometry.Transform.ChangeBasis(plane, wxy_plane);


      Box box = new Rhino.Geometry.Box(bbox);
      box.Transform(plane_to_world);
      return box;
    }

    public double BoxArea(Box box)
    {
      return (box.X[1] - box.X[0]) * (box.Y[1] - box.Y[0]);
    }


    public void PlanarMinBB(List<GeometryBase> objs, Plane plane, double tot_ang, int divs, out Plane curr_plane, out double curr_area)
    {
      double inc = tot_ang / divs;
      //rotate plane half total angle minus direction
      plane.Rotate(-tot_ang * 0.5, plane.ZAxis, plane.Origin);
      Box bb = BoundingBoxPlane(objs, plane, true);
      curr_plane = new Plane(plane);
      curr_area = BoxArea(bb);
      //loop through angle increments
      for(int i = 0; i < divs; i++)
      {
        plane.Rotate(inc, plane.ZAxis, plane.Origin);
        bb = BoundingBoxPlane(objs, plane, true);
        double new_area = BoxArea(bb);
        if (new_area < curr_area)
        {
          curr_area = new_area;
          curr_plane = plane;
        }
      }


    }

    public void MinBoundingRectanglePlane(List<GeometryBase> objs, Plane curr_plane, bool im_rep, out Box f_bb, out Double curr_area, out int i, out List<string> insidemsg)
    {
      //pass True argument above if you want to print intermediate results
      //initialize
      double factor = 0.01;  //0.01 (1/100 of model abs tolerance)
      double angle = Math.PI * 0.5; //start angle 90 degrees
      int divs = 90;  //initial division 1 degree intervals
      RhinoDoc rd = RhinoDoc.ActiveDoc;
      double tol = rd.ModelAbsoluteTolerance;
      insidemsg = new List<string>();
      string err_msg = "Unable to calculate bouding box area";


      f_bb = new Box();
      i = 0;





      ///get initial rough bounding box

      Box init_bb = BoundingBoxPlane(objs, curr_plane, false);
      curr_area = BoxArea(init_bb);
      if (im_rep == true)
      {
        insidemsg.Add("Initial area:" + curr_area.ToString());
      }

      //main calculation loop
      int safe = 10;

      for (i = 0; i < safe; i++)
      {

        PlanarMinBB(objs, curr_plane, angle, divs, out curr_plane, out curr_area);
        double new_area = curr_area;
        //abort if area is 0 or extremly small
        if (new_area < tol * 0.1)
        {
          insidemsg.Add(err_msg);
          return;
        }
        //break out of loop if new area is the smae as prev. area within limit
        if (Math.Abs(curr_area - new_area) < factor * tol)
        {

          break;
        }
        //otherwise,decrease increments and loop
        curr_area = new_area;
        angle *= (1 / divs);

        if(im_rep == true)
        {
          int k = i + 1;
          insidemsg.Add("Refine stage" + k.ToString() + "Area:" + curr_area.ToString());
          Rhino.RhinoApp.Wait();//wait for command line to print...

        }
        if (i == 10)
        {
          insidemsg.Add("Max loop limit reached");//debug
        }
      }

      f_bb = BoundingBoxPlane(objs, curr_plane, true);


    }

    public Plane CheckObjCoPlanarity(List<GeometryBase> objs)
    {
      List<Point3d> ptlist = new List<Point3d>();
      Plane myplane = new Plane();
      bool myresult = new bool();
      RhinoDoc rd = RhinoDoc.ActiveDoc;
      double tol = rd.ModelAbsoluteTolerance;
      foreach (var obj in objs)
      {
        if (obj is Rhino.Geometry.Curve)
        {
          Curve objcurve = (Curve) obj;
          myresult = objcurve.TryGetPlane(out myplane, tol);

          if (myresult == false)
          {
            myplane = default(Plane);
            return myplane;
          }

          NurbsCurve mynurbscurve = objcurve.ToNurbsCurve();

          if(mynurbscurve == default(NurbsCurve))
          {
            myplane = default(Plane);
            return myplane;
          }

          for (int i = 0; i < mynurbscurve.Points.Count; i = i + 1)
          {

            ptlist.Add(mynurbscurve.Points[i].Location);

          }

        }

        else if (obj is Rhino.Geometry.Point)
        {
          Point objpoint = (Point) obj;
          ptlist.Add(objpoint.Location);

        }

        else if (obj is Rhino.Geometry.PointCloud)
        {
          PointCloud objpointcloud = (PointCloud) obj;
          Point3d[] ptarray = objpointcloud.GetPoints();
          foreach (Point3d i in ptarray)
          {
            ptlist.Add(i);
          }

        }

        else if (obj is Rhino.Geometry.Brep)
        {
          Brep objbrep = (Brep) obj;
          foreach (BrepFace face in objbrep.Faces)
          {
            myresult = face.TryGetPlane(out myplane, tol);

            if (myresult == false)
            {
              myplane = default(Plane);
              return myplane;
            }
            NurbsSurface mysurfaceface = face.ToNurbsSurface();

            if (mysurfaceface == default(NurbsSurface))
            {
              myplane = default(Plane);
              return myplane;
            }

            foreach (ControlPoint cp in mysurfaceface.Points)
            {
              ptlist.Add(cp.Location);
            }

          }
        }

        else if (obj is Rhino.Geometry.Surface)
        {
          Surface objsurface = (Surface) obj;
          myresult = objsurface.TryGetPlane(out myplane, tol);
          if (myresult == false)
          {
            myplane = default(Plane);
            return myplane;
          }

          NurbsSurface mysurfaceface = objsurface.ToNurbsSurface();

          if(mysurfaceface == default(NurbsSurface))
          {
            myplane = default(Plane);
            return myplane;
          }


          foreach (ControlPoint cp in mysurfaceface.Points)
          {
            ptlist.Add(cp.Location);
          }



        }

        else if (obj is Rhino.Geometry.Extrusion)
        {
          Extrusion objextrusion = (Extrusion) obj;
          myresult = objextrusion.TryGetPlane(out myplane, tol);
          if (myresult == false)
          {
            myplane = default(Plane);
            return myplane;
          }

          NurbsSurface mysurfaceface = objextrusion.ToNurbsSurface();
          if (mysurfaceface == default(NurbsSurface))
          {
            myplane = default(Plane);
            return myplane;
          }
          foreach (ControlPoint cp in mysurfaceface.Points)
          {
            ptlist.Add(cp.Location);
          }

        }

        else if (obj is Rhino.Geometry.Mesh)
        {
          Mesh objmesh = (Mesh) obj;
          foreach (Point3d vert in objmesh.Vertices)
          {
            ptlist.Add(vert);

          }

        }

        else
        {
          return myplane;
        }

      }
      Plane.FitPlaneToPoints(ptlist, out myplane);
      return myplane;
    }
    public Box CombinedMinBBMulti(List<GeometryBase> objs, int fine_sample, bool im_rep, out List<string> msg, out Box bb)
    {
      msg = new List<string>();
      int prec = Rhino.RhinoDoc.ActiveDoc.DistanceDisplayPrecision;
      string us = Rhino.RhinoDoc.ActiveDoc.GetUnitSystemName(true, false, false, false);

      List<GeometryBase> inputs = objs;
      int count = fine_sample;
      int passes = 0;
      bb = Box.Empty;
      List<string> insidemsg = new List<string>();


      msg.Add("checking object planarity/coplanarity...\r\n");

      DateTime starttime = System.DateTime.Now;


      Plane plane = CheckObjCoPlanarity(objs);

      if(plane != default(Plane))
      {
        if (objs.Count == 1)
        {
          msg.Add("Selected object is planar -\r\n");
        }
        else
        {
          msg.Add("All selected objects are coplanar - \r\n");
          msg.Add("launching 2D planar bounding rectangle calculation.\r\n");
        }


        //launch planar bounding box routine

        Box f_bb = Box.Empty;
        Point3d[] f_bbpt = Box.Empty.GetCorners();
        double curr_area = 0.0;
        int i = 0;


        MinBoundingRectanglePlane(objs, plane, im_rep, out f_bb, out curr_area, out i, out insidemsg);

        foreach (string x in insidemsg)
        {
          msg.Add(x);
        }

        passes = i;


        bb = f_bb;

        double fa = Math.Round(curr_area, prec);


        msg.Add(passes.ToString() + " refinement stages\r\n");
        msg.Add("Minimum bounding box area = " + fa.ToString() + " sq " + us.ToString() + "\r\n");

        DateTime endtime = System.DateTime.Now;
        double costtime = (endtime - starttime).TotalMilliseconds;

        msg.Add("Elapsed time: " + costtime.ToString() + " Milliseconds");


      }

      else
      {
        // standard sample count=10 --> 1000 boxes per pass
        // fine sample count=18 --> 5832 boxes per pass     //dont use here




        if(objs.Count == 1)
        {
          msg.Add("Selected object is not planar -\r\n");
        }

        else
        {
          msg.Add("Selected object are not planar -\r\n");
        }

        msg.Add("launching 3D bounding box calculation.\r\n");
        double curr_vol = 0.0;
        Plane wxy_plane = Rhino.Geometry.Plane.WorldXY;
        Box curr_bb = Box.Empty;

        Min3DBoundingBox(objs, wxy_plane, count, false, im_rep, out curr_bb, out curr_vol, out passes, out insidemsg);
        foreach (string x in insidemsg)
        {
          msg.Add(x);
        }

        bb = curr_bb;
        double fv = Math.Round(curr_vol, prec);
        msg.Add("Final volume after " + passes.ToString() + " passes is " + fv.ToString() + " sq3 " + us.ToString());

        DateTime endtime = System.DateTime.Now;
        double costtime = (endtime - starttime).TotalMilliseconds;

        msg.Add("Elapsed time: " + costtime.ToString() + " Milliseconds");


      }
      return bb;

    }
    public List<Plane> RotatedPlaneArray(Plane plane, double tot_ang, int divs, Vector3d axis)
    {
      List<Plane> out_plane = new List<Plane>();
      plane.Rotate(-tot_ang * 0.5, axis);
      out_plane.Add(new Rhino.Geometry.Plane(plane));
      double inc = tot_ang / (divs - 1);
      for(int i = 0; i < divs - 1; i++)
      {
        plane.Rotate(inc, axis);
        out_plane.Add(new Rhino.Geometry.Plane(plane));
      }
      return out_plane;
    }

    public List<Plane> RotatePlaneArray3D(Plane view_plane, double tot_ang, int divs)
    {
      //generate a 3D array of refinement planes (works with narrow angles)
      List<Plane> out_planes = new List<Plane>();
      //use RotatedPlaneArray to generate 'horizontal' left-right array (yaw)
      List<Plane> yaw_planes = RotatedPlaneArray(view_plane, tot_ang, divs, view_plane.ZAxis);
      foreach (Plane y_plane in yaw_planes)
      {
        //use RotatedPlaneArray to generate up-down 'tilt' array(roll)
        List<Plane> roll_planes = RotatedPlaneArray(y_plane, tot_ang, divs, y_plane.YAxis);

        foreach (Plane r_plane in roll_planes)
        {
          //use RotatedPlaneArray to generate up-down 'tilt' array(pitch)
          List<Plane> pitch_planes = RotatedPlaneArray(r_plane, tot_ang, divs, r_plane.XAxis);

          foreach (Plane p_plane in pitch_planes)
          {
            out_planes.Add(p_plane);
          }

        }
      }
      return out_planes;
    }
    public List<Plane> GenerateOctantPlane(int count)
    {
      double tot_ang = Math.PI * 0.5;
      // generates an array of count^3 planes in 3 axes covering xyz positive octant
      Plane yz_plane = Rhino.Geometry.Plane.WorldYZ;
      List<Plane> yz_planelist = new List<Plane>();
      yz_planelist.Add(yz_plane);
      Vector3d Xdir_vec = new Rhino.Geometry.Vector3d(1, 0, 0); //X axis
      List<Plane> x_planes = RotateCopyPlanes(tot_ang, count, yz_planelist, Xdir_vec);


      Vector3d Ydir_vec = new Rhino.Geometry.Vector3d(0, -1, 0); //-Y axis
      List<Plane> xy_planes = RotateCopyPlanes(tot_ang, count, x_planes, Ydir_vec);

      Vector3d Zdir_vec = new Rhino.Geometry.Vector3d(0, 0, 1); //Z axis
      List<Plane> xyz_planes = RotateCopyPlanes(tot_ang, count, xy_planes, Zdir_vec);

      return xyz_planes;

    }
    public List<Plane> RotateCopyPlanes(double tot_ang, int count, List<Plane> init_planes, Vector3d dir_vec)
    {
      double inc = tot_ang / (count - 1);
      Point3d origin = new Rhino.Geometry.Point3d(0, 0, 0);
      List<Plane> planes = new List<Plane>();
      for (int i = 0; i < count; i++)
      {
        foreach (Plane init_plane in init_planes)
        {
          Plane new_plane = new Rhino.Geometry.Plane(init_plane);
          new_plane.Rotate(inc * i, dir_vec, origin);
          planes.Add(new_plane);
        }
      }
      return planes;
    }


    public void MinBBPlane(List<GeometryBase> objs, ref Plane best_plane, List<Plane> planes, ref Box curr_box, ref double curr_vol)
    {



      foreach (Plane plane in planes)
      {
        Box bb = BoundingBoxPlane(objs, plane,true);

        if (bb.Volume < curr_vol)
        {
          curr_vol = bb.Volume;
          best_plane = plane;
          curr_box = bb;
        }

      }

    }
    public void Min3DBoundingBox(List<GeometryBase> objs, Plane init_plane, int count, bool rel_stop, bool im_rep, out Box curr_bb, out double curr_vol, out int passes, out List<string> insidemsg)
    {
      // for non-planar or non-coplanar object(s)
      // get initial fast bb in init plane (World XY), plus volume to compare
      //this is the main 2D bb calculation search function

      curr_bb = BoundingBoxPlane(objs, init_plane,true);

      curr_vol = curr_bb.Volume;

      double tot_ang = Math.PI * 0.5;  //90 degrees for intial octant
      double factor = 0.1; //angle reduction factor for each successive refinement pass
      int max_passes = 20; //safety factor
      int prec = Rhino.RhinoDoc.ActiveDoc.DistanceDisplayPrecision;
      string us = Rhino.RhinoDoc.ActiveDoc.GetUnitSystemName(true, false, false, false);
      insidemsg = new List<string>();
      //run intitial bb calculation
      List<Plane> xyz_planes = GenerateOctantPlane(count);
      Plane best_plane = new Plane();
      MinBBPlane(objs, ref best_plane, xyz_planes, ref curr_bb, ref curr_vol);
      //report the results of intial rough calculation
      if (im_rep == true)
      {
        double roundcurr_vol = System.Math.Round(curr_vol, prec);
        insidemsg.Add("Initial pass 0, volume: " + roundcurr_vol.ToString() + " cu " + us.ToString());
      }
      //refine with smaller angles arround best fit plane, loop until...
      int i = 0;
      for(i = 0; i < max_passes; i++)
      {
        double prev_vol = curr_vol;

        //reduce angle by factor, use refinement planes to generate array

        tot_ang *= factor;
        List <Plane> ref_planes = RotatePlaneArray3D(best_plane, tot_ang, count);
        MinBBPlane(objs, ref best_plane, ref_planes, ref curr_bb, ref curr_vol);

        double vol_diff = prev_vol - curr_vol;//vol. diff. over last pass, should be positive or 0
        if (im_rep == true)
        {
          insidemsg.Add("Volume difference from last pass:  " + vol_diff.ToString());
        }
        // check if difference is less than minimum "significant"
        // rel_stop==True: relative stop value <.01% difference from previous

        if (rel_stop == true)
        {
          if (vol_diff < 0.0001 * prev_vol)
          {
            break;
          }
        }
        else
        {
          RhinoDoc rd = RhinoDoc.ActiveDoc;
          if (vol_diff < rd.ModelAbsoluteTolerance)
          {
            break;
          }
        }
        Rhino.RhinoApp.Wait();

        if (im_rep == true)
        {
          int k = i + 1;
          double roundcurr_vol = System.Math.Round(curr_vol, prec);
          insidemsg.Add("Refine pass" + k.ToString() + "  volume: " + roundcurr_vol.ToString() + " cu " + us.ToString());
        }

        //get out of loop if escape is pressed

        //if (Console.ReadKey().Key != ConsoleKey.Escape)
        //{
        //Console.WriteLine("Refinement aborted after {0} passes", i + 1);
        //break;
        //}
      }
      passes = i + 1;


    }

  }
# ---------- end c_script_11 ----------
panel_18 = Panel(c_script_11.out)
c_script_12 = CSharpScript()  # -> out, A, B, C
# ---------- c_script_12: C# ----------
    DateTime starttime = System.DateTime.Now;
    int a = 0;
    for(int i = 0; i < 100000000;i++)
    {
       a = a + 1;
    }
    DateTime endtime = System.DateTime.Now;
    double stime = (endtime - starttime).TotalMilliseconds;
    A = starttime;
    B = endtime;
    C = stime;
# ---------- end c_script_12 ----------
panel_19 = Panel(c_script_11.B)
# button
c_script_13 = CSharpScript()  # -> Out, A
panel_20 = Panel(c_script_12.A)
panel_21 = Panel(c_script_12.B)
panel_22 = Panel(c_script_12.C)
